# Grasshopper definition 00_Del_RiR.gh (Grasshopper 1.0.8)
# plug-ins: Rhino.Inside for Autodesk Revit

doubleclick = BooleanToggle(False)
dss_annotation_panel = Panel("Help on WhiteWork")
# Segment
# group modules into larger coherent parts
# User Interface: I/O
dss_log_v5_2 = PythonScript(Help=doubleclick)  # inputs Help: Boolean
# ---------- dss_log_v5_2: Python ----------
"""
Set grasshopper template and provide easy acces to Help file in intranet

"""

"""
Credits:
    20211117
    Created by Vladimir Ondejcik
    White arkitekter AB

Based on:
    WOMBAT version <0.0.1>
    Script by <Brian Ringley>
        def libraries() by <Giulio Piacentino> see <http://www.grasshopper3d.com/forum/topics/gh-filename-is-python>
        def writeToFile() by <Data Analytics Society> see <https://www.youtube.com/watch?v=-TF3mXhnCDw>
    Script version <15 September 2015> 
    Copyright <Creative Commons Sharealike>
"""


#add dsearch default path located on cad.local
import sys
new_path = r"\\sesthfs02\DSEARCH\REPOSITORY\Grasshopper\Xtras\DsearchCode"
if new_path not in sys.path: sys.path.append(new_path)

#import dsearch plugin
import dsearch as ds

import os

print sys.path

#reload module (this has use when working on module)
#reload(ds.DS_Log)
#reload(ds.DS_Links)

#setup template
template=ds.DS_Links.Template
ds.DS_Log.DS_Template(template)

#run help from module 
if Help:
    helpLink=ds.DS_Links.HelpLink
    ds.DS_Log.DS_Help(helpLink)

    #turn toggle back to false
    obj=ghenv.Component.Params.Input[0].Sources[0]
    obj.Value=False
    obj.ExpireSolution(True)
# ---------- end dss_log_v5_2 ----------

dss_projectnumber = Panel("0000")
dss_projectname = Panel("name")

# ----
# Organization of Grasshopper scripts at White:
# Script should be created and annotated always with notion that other person will need to use/edit them.
# Build your script in modules and segments, use color coding and annotation according this template.
# This standard should be applied to all scripts, big or small.
# 
# Read  guide on white work:
# "https://work.white.se/grasshopper-developer-guide/"
# For Advanced users:
# For design scripts running more than a month use "dsInitialize" and "dsScriptLog" functions on Dsearch tab to log changes over time.
dss_annotation_panel_2 = Panel("""Tip of a day:
You can change default colour grups by right clicking
Graphical templates are located on "Dsearch" tab""")
# GRAPHIC
# STANDARD
# In
# data and geometry import from rhino or external platforms
image = ImageSampler(dss_annotation_panel_2, Filter="Colour", Interpolate=False, Umax=1, Umin=0, Vmax=1, Vmin=0, Wrap=0)

# ----
# Control
# General
# Monitor
# Out
# variable parameters and script execution
# (sliders, boolean togggle, text input,...)
# monitor data and geometry preview (used for panels for example)
# output data to rhino or external platforms
# WIP
# Annotation
# Plugin
# general annotation and notes
# textbased scripting and special plugins
# f.ex: HumanUI, kangaroo,...
# problematic or under repair or construction
dss_annotation_panel_3 = Panel("general development modules")

# ---- group: Filled region
query_categories = QueryCategories(Type=1, Name="Detail Items", IsVisibleUI=True, IsSubcategory=False)
query_types = QueryTypes(Kind=3, Category=query_categories)
txt = Text("Filled Region_RiR")
tmatch = MatchText(Text=query_types, RegEx=txt, Case=True)
cull_pattern = CullPattern(List=query_types, CullPattern=tmatch)
typefltr = TypeFilter(Types=cull_pattern, Inverted=False)

# ----
query_line_styles = QueryLineStyles(Name="Dimension_RiR")
active_view = ActiveView()
query_types_2 = QueryTypes(Kind=3)
query_categories_2 = QueryCategories(Type=2, Name="Dimensions", IsVisibleUI=True, IsSubcategory=False)
query_categories_3 = QueryCategories(Type=1, Name="Lines", IsVisibleUI=True, IsSubcategory=False)
txt_2 = Text("Dimension_RiR")
tmatch_2 = MatchText(Text=query_types_2, RegEx=txt_2, Case=True)
query_view_elements = QueryViewElements(View=active_view, Categories=query_categories_2)
query_view_elements_2 = QueryViewElements(View=active_view, Categories=query_categories_3)
curve_line_style = CurveLineStyle(Element=query_view_elements_2)  # -> Element, LineStyle
tmatch_3 = MatchText(Text=curve_line_style.LineStyle, RegEx="Dimension_RiR", Case=True)
# Back-end
cull = CullPattern(List=curve_line_style.Element, CullPattern=tmatch_3)

# ---- group: Filled region (continued)
query_view_elements_3 = QueryViewElements(View=active_view, Categories=query_categories)
filtelem = FilterElements(Elements=query_view_elements_3, Filter=typefltr)
cull_2 = CullPattern(List=query_view_elements_3, CullPattern=filtelem)

# ----
cull_3 = CullPattern(List=query_types_2, CullPattern=tmatch_2)
tmatch_4 = MatchText(Text=curve_line_style.LineStyle, RegEx="Kontroll_RiR", Case=True)
cull_4 = CullPattern(List=curve_line_style.Element, CullPattern=tmatch_4)

typefltr_2 = TypeFilter(Types=cull_3, Inverted=False)
filtelem_2 = FilterElements(Elements=query_view_elements, Filter=typefltr_2)
cull_5 = CullPattern(List=query_view_elements, CullPattern=filtelem_2)
delete_element = DeleteElement(Elements=[cull, cull_5, cull_2, cull_4])
