# Grasshopper definition 01_Dim_Rooms.gh (Grasshopper 1.0.8)
# plug-ins: Heteroptera, Rhino.Inside for Autodesk Revit

doubleclick = BooleanToggle(False)
dss_annotation_panel = Panel("Help on WhiteWork")
# Segment
# group modules into larger coherent parts
# User Interface: I/O
dss_log_v5_2 = PythonScript(Help=doubleclick)  # inputs Help: Boolean
# ---------- dss_log_v5_2: Python ----------
"""
Set grasshopper template and provide easy acces to Help file in intranet

"""

"""
Credits:
    20211117
    Created by Vladimir Ondejcik
    White arkitekter AB

Based on:
    WOMBAT version <0.0.1>
    Script by <Brian Ringley>
        def libraries() by <Giulio Piacentino> see <http://www.grasshopper3d.com/forum/topics/gh-filename-is-python>
        def writeToFile() by <Data Analytics Society> see <https://www.youtube.com/watch?v=-TF3mXhnCDw>
    Script version <15 September 2015> 
    Copyright <Creative Commons Sharealike>
"""


#add dsearch default path located on cad.local
import sys
new_path = r"\\sesthfs02\DSEARCH\REPOSITORY\Grasshopper\Xtras\DsearchCode"
if new_path not in sys.path: sys.path.append(new_path)

#import dsearch plugin
import dsearch as ds

import os

print sys.path

#reload module (this has use when working on module)
#reload(ds.DS_Log)
#reload(ds.DS_Links)

#setup template
template=ds.DS_Links.Template
ds.DS_Log.DS_Template(template)

#run help from module 
if Help:
    helpLink=ds.DS_Links.HelpLink
    ds.DS_Log.DS_Help(helpLink)

    #turn toggle back to false
    obj=ghenv.Component.Params.Input[0].Sources[0]
    obj.Value=False
    obj.ExpireSolution(True)
# ---------- end dss_log_v5_2 ----------

dss_projectnumber = Panel("0000")
dss_projectname = Panel("name")

# ----
# Organization of Grasshopper scripts at White:
# Script should be created and annotated always with notion that other person will need to use/edit them.
# Build your script in modules and segments, use color coding and annotation according this template.
# This standard should be applied to all scripts, big or small.
# 
# Read  guide on white work:
# "https://work.white.se/grasshopper-developer-guide/"
# For Advanced users:
# For design scripts running more than a month use "dsInitialize" and "dsScriptLog" functions on Dsearch tab to log changes over time.
dss_annotation_panel_2 = Panel("""Tip of a day:
You can change default colour grups by right clicking
Graphical templates are located on "Dsearch" tab""")
# GRAPHIC
# STANDARD
# In
# data and geometry import from rhino or external platforms
image = ImageSampler(dss_annotation_panel_2, Filter="Colour", Interpolate=False, Umax=1, Umin=0, Vmax=1, Vmin=0, Wrap=0)

# ----
# Control
# General
# Monitor
# Out
# variable parameters and script execution
# (sliders, boolean togggle, text input,...)
# monitor data and geometry preview (used for panels for example)
# output data to rhino or external platforms
# WIP
# Annotation
# Plugin
# general annotation and notes
# textbased scripting and special plugins
# f.ex: HumanUI, kangaroo,...
# problematic or under repair or construction
dss_annotation_panel_3 = Panel("general development modules")

active_view = ActiveView()
query_categories = QueryCategories(Type=1, Name="Rooms", IsVisibleUI=True, IsSubcategory=False)

# ---- group: Style of dimension
query_types = QueryTypes(Kind=7)

# ---- group: Color of dimensions
colour_swatch = ColourSwatch(SwatchColor=RGB(204, 54, 49))

# ----
query_view_elements = QueryViewElements(View=active_view, Categories=query_categories)
tmatch = MatchText(Text=query_types, RegEx="Kontroll", Case=True)
cull = CullPattern(List=query_types, CullPattern=tmatch)

half_length_of_detail_lines = Panel("100")
position_of_dimension_line_2_curve_param = Panel("0.4")  # "Position of dimension line 2(Curve Parameter)"
# Back-end
# Places dimensions on revit rooms. Walls needs to be orthogonal. Places a dimension from every wall to an wall on the opposite side of the room.
# RiR dimensions can so far (August 2022) only referance center of walls. To get a dimension placed att the wall face a short detail line is placed, and the dimension is referenced to the detail line.
# Since the script draws dimensions for rooms, dimensions may be at the center of walls when it comes to curtain walls, because of the room border being there.
# Recommended is to create a specific type for the dimensions (& detail lines) created from RiR ao that they are easy to find and remove if something goes wrong.
deletedimension = Trigger(Interval=-1000, TimerInterval=1000)

room = Room(query_view_elements)
view = View(active_view)

tmatch_2 = MatchText(Text=cull, RegEx="Linear*", Case=True)
cull_2 = CullPattern(List=cull, CullPattern=tmatch_2)
item = ListItem(List=cull_2, Index=0, Wrap=True)
# Places dimensions on rooms (Walls must be orthogonal)
spatial_element_boundary = SpatialElementBoundary(SpatialElement=room, BoundaryLocation=0)
duplicate_type = DuplicateType(TypeName="Dimension_RiR_Rooms", Type=item, FailureProcessingMode=1, TrackingMode=2)

# ----
# Create custom line style
built_in_categories = BuiltInCategories("autodesk.revit.category.local:lines-1.0.0", LayoutLevel=2, SearchPattern="lines")
query_line_patterns = QueryLinePatterns()
value_picker = ValuePicker(query_line_patterns)
add_subcategory = AddSubCategory(Parent=built_in_categories, Name="Line_Dimension_RiR_Rooms", FailureProcessingMode=1, TrackingMode=2)
category_style = CategoryStyle(Category=add_subcategory, LineColor=colour_swatch, LinePattern_projection=value_picker)  # -> Category, LineWeight_projection, LineWeight_cut, LineColor, LinePattern_projection, Material

# ----
# Simplifying Wall location lines
join_curves = JoinCurves(Curves=spatial_element_boundary, Preserve=False)  # -> simplify(Curves)
simplify_curve = SimplifyCurve(Curve=join_curves)  # -> Curve, Simplified
explode = Explode(Curve=simplify_curve.Curve, Recursive=True)  # -> simplify(Segments), Vertices
line = Line(explode.Segments)

# ---- group: Creating new dimension style
inspect_element = InspectElement(Element=duplicate_type)
element_parameter = ElementParameter(Element=duplicate_type, Parameter=inspect_element, Value=colour_swatch)  # -> Element, Value

# ----
# Orders the room boundary curves so they start in the corner closest to (0,0,0) and have the same direction.
line_2 = Line(line)

join_curves_2 = JoinCurves(Curves=line_2, Preserve=False)  # -> simplify(flatten(Curves))
list_item = ListItem(List=join_curves_2, Index=0, Wrap=True)
flip_curve = FlipCurve(Curve=join_curves_2, Guide=list_item)  # -> Curve, Flag
explode_2 = Explode(Curve=flip_curve.Curve, Recursive=True)  # -> simplify(Segments), Vertices

construct_point = ConstructPoint(XCoordinate=0, YCoordinate=0, ZCoordinate=0)
end_points = EndPoints(Curve=explode_2.Segments)  # -> Start, End
distance = Distance(PointA=end_points.Start, PointB=construct_point)
min_max = MinMax(Number=distance)  # -> Minimum, Maximum
member_index = MemberIndex(Set=distance, Member=min_max.Minimum)  # -> simplify(Index), Count

shift_list = ShiftList(List=explode_2.Segments, Shift=member_index.Index, Wrap=True)
line_3 = Line(simplify(shift_list))

# ----
# Creating lines (length 100m) to check for intersection with room boundary
number = Number(position_of_dimension_line_2_curve_param)
line_4 = Line(line_3)
evaluate_curve = EvaluateCurve(Curve=reparameterize(line_4), Parameter=number)  # -> Point, Tangent, Angle
unit_z = UnitZ(Factor=1)
cross_product = CrossProduct(VectorA=unit_z, VectorB=evaluate_curve.Tangent, Unitize=False)  # -> Vector, Length
length_of_line = Panel("100000")
multiplication = Multiplication(A=cross_product.Vector, B=length_of_line)
move = Move(Geometry=evaluate_curve.Point, Motion=multiplication)  # -> Geometry, Transform
line_5 = Line(StartPoint=evaluate_curve.Point, EndPoint=move.Geometry)  # -> simplify(Line)

join_curves_3 = JoinCurves(Curves=line_4, Preserve=False)  # -> simplify(Curves)
dsannotation = Panel("Rroom boundary")

# ----
# Creating posible dimension lines guides
number_slider = Slider(1, range=0..1)
curve_line = CurveLine(Curve=join_curves_3, Line=line_5)  # -> Points, Params, Count
list_item_2 = ListItem(List=curve_line.Points, Index=0, Wrap=True)
list_item_3 = ListItem(List=curve_line.Points, Index=number_slider, Wrap=True)
line_6 = Line(StartPoint=list_item_2, EndPoint=list_item_3)  # -> simplify(Line)
path_mapper = PathMapper(line_6, source="{a;b}", target="{a}")

line_7 = Line(path_mapper)

# ----
# Sorting away equally long lines (so we won´t get doubles)
length = Length(Curve=line_7)
integer = Integer(length)
findunique = CSharpScript(CrvLength=integer)  # -> out, UniqueLengths, A; inputs CrvLength: tree of Int32
# ---------- findunique: C# ----------
    for (int i = 0; i < CrvLength.BranchCount; i++)
    {
      List <int> Lengths = new List<int>();
      Lengths.Add(CrvLength.Branch(i)[0]);
      for (int j = 1; j < CrvLength.Branch(i).Count; j++)
      {
        bool Lbool = false;
        for (int k = 0; k < Lengths.Count; k++)
        {
          if(Lengths[k] == CrvLength.Branch(i)[j])
          {
            Lbool = true;
          }
        }
        Lengths.Add(CrvLength.Branch(i)[j]);
        if (Lbool == false)
        {
          CrvLength.Branch(i)[j] = 1;
        }
        else
        {
          CrvLength.Branch(i)[j] = 0;
        }
      }
      CrvLength.Branch(i)[0] = 1;
      A = Lengths;
    }
    
    UniqueLengths = CrvLength;
# ---------- end findunique ----------
cull_pattern = CullPattern(List=path_mapper, CullPattern=findunique.UniqueLengths)

# ----
# Creating lines to be transformed into detail lines (references for the dimensions)
unit_z_2 = UnitZ(Factor=1)
vector = Vector(unitize(cull_pattern))
cross_product_2 = CrossProduct(VectorA=vector, VectorB=unit_z_2, Unitize=False)  # -> Vector, Length
halflengthofdetailline = Number(half_length_of_detail_lines)
multiplication_2 = Multiplication(A=cross_product_2.Vector, B=halflengthofdetailline)
negative = Negative(Value=multiplication_2)
end_points_2 = EndPoints(Curve=cull_pattern)  # -> Start, End
move_2 = Move(Geometry=end_points_2.End, Motion=multiplication_2)  # -> Geometry, Transform
move_3 = Move(Geometry=end_points_2.End, Motion=negative)  # -> Geometry, Transform
move_4 = Move(Geometry=end_points_2.Start, Motion=multiplication_2)  # -> Geometry, Transform
move_5 = Move(Geometry=end_points_2.Start, Motion=negative)  # -> Geometry, Transform
line_8 = Line(StartPoint=move_2.Geometry, EndPoint=move_3.Geometry)  # -> graft(Line)
line_9 = Line(StartPoint=move_4.Geometry, EndPoint=move_5.Geometry)  # -> graft(Line)

line_10 = Line(graft(cull_pattern))
line_11 = Line([line_9, line_8])

# ----
# Writing to Revit view
view_2 = View(view)
line_12 = Line(line_10)
curve = Curve(line_11)
add_detail_line = AddDetailLine(View=view_2, Curve=curve)

clean = CleanTree(RemoveNulls=True, RemoveInvalid=True, RemoveEmpty=True, Tree=add_detail_line)
tstat = TreeStatistics(Tree=clean)  # -> Paths, Length, Count
branch = TreeBranch(Tree=line_12, Path=tstat.Paths, MaintainPaths=True)

add_aligned_dimension = AddAlignedDimension(View=view_2, References=clean, Line=branch)  # -> simplify(Dimension)

curve_line_style = CurveLineStyle(Element=add_detail_line, LineStyle=category_style.Category)  # -> Element, LineStyle
pin_element = PinElement(Element=add_aligned_dimension, Pinned=Toggle(False))  # -> Element, Pinned
element_type = ElementType(Element=add_aligned_dimension, Type=element_parameter.Element)  # -> simplify(Element), Type
