# Grasshopper definition 02_Dim_Wall_Grid.gh (Grasshopper 1.0.8)
# plug-ins: Pufferfish, Rhino.Inside for Autodesk Revit, Wombat

doubleclick = BooleanToggle(False)
dss_annotation_panel = Panel("Help on WhiteWork")
# Segment
# group modules into larger coherent parts
# User Interface: I/O
dss_log_v5_2 = PythonScript(Help=doubleclick)  # inputs Help: Boolean
# ---------- dss_log_v5_2: Python ----------
"""
Set grasshopper template and provide easy acces to Help file in intranet

"""

"""
Credits:
    20211117
    Created by Vladimir Ondejcik
    White arkitekter AB

Based on:
    WOMBAT version <0.0.1>
    Script by <Brian Ringley>
        def libraries() by <Giulio Piacentino> see <http://www.grasshopper3d.com/forum/topics/gh-filename-is-python>
        def writeToFile() by <Data Analytics Society> see <https://www.youtube.com/watch?v=-TF3mXhnCDw>
    Script version <15 September 2015> 
    Copyright <Creative Commons Sharealike>
"""


#add dsearch default path located on cad.local
import sys
new_path = r"\\sesthfs02\DSEARCH\REPOSITORY\Grasshopper\Xtras\DsearchCode"
if new_path not in sys.path: sys.path.append(new_path)

#import dsearch plugin
import dsearch as ds

import os

print sys.path

#reload module (this has use when working on module)
#reload(ds.DS_Log)
#reload(ds.DS_Links)

#setup template
template=ds.DS_Links.Template
ds.DS_Log.DS_Template(template)

#run help from module 
if Help:
    helpLink=ds.DS_Links.HelpLink
    ds.DS_Log.DS_Help(helpLink)

    #turn toggle back to false
    obj=ghenv.Component.Params.Input[0].Sources[0]
    obj.Value=False
    obj.ExpireSolution(True)
# ---------- end dss_log_v5_2 ----------

dss_tags = Panel("tags, tags")
dss_description = Panel("description")

# ----
# PROJECT INFO
dss_projectnumber = Panel("0000")
dss_projectname = Panel("name")

# ----
# Organization of Grasshopper scripts at White:
# Script should be created and annotated always with notion that other person will need to use/edit them.
# Build your script in modules and segments, use color coding and annotation according this template.
# This standard should be applied to all scripts, big or small.
# 
# Read  guide on white work:
# "https://work.white.se/grasshopper-developer-guide/"
# READ ME
# For Advanced users:
# For design scripts running more than a month use "dsInitialize" and "dsScriptLog" functions on Dsearch tab to log changes over time.
dss_annotation_panel_2 = Panel("""Tip of a day:
You can change default colour grups by right clicking
Graphical templates are located on "Dsearch" tab""")
# GRAPHIC
# STANDARD
# In
# data and geometry import from rhino or external platforms
image = ImageSampler(dss_annotation_panel_2, Filter="Colour", Interpolate=False, Umax=1, Umin=0, Vmax=1, Vmin=0, Wrap=0)

# ---- group: Style of dimension
query_types = QueryTypes(Kind=7)

# ---- group: Color of dimensions
colour_swatch = ColourSwatch(SwatchColor=RGB(204, 107, 104))

# ----
# Create custom line style
panel = Panel("Line_Dimension_RiR_Rooms")
built_in_categories = BuiltInCategories("autodesk.revit.category.local:lines-1.0.0", LayoutLevel=2, SearchPattern="lines")
query_line_patterns = QueryLinePatterns()
add_subcategory = AddSubCategory(Parent=built_in_categories, Name=panel, FailureProcessingMode=1, TrackingMode=2)
value_picker = ValuePicker(query_line_patterns)
category_style = CategoryStyle(Category=add_subcategory, LinePattern_projection=value_picker)  # -> Category, LineWeight_projection, LineWeight_cut, LineColor, LinePattern_projection, Material

# ---- group: To finish(false) or middle(true) of wall
toggle = BooleanToggle(False)

# ----
active_view = ActiveView()

tmatch = MatchText(Text=query_types, RegEx="Kontrollmåttsättning", Case=True)
cull = CullPattern(List=query_types, CullPattern=tmatch)

tmatch_2 = MatchText(Text=query_types, RegEx="Linear", Case=True)
tmatch_3 = MatchText(Text=query_types, RegEx="Kontroll", Case=True)
cull_2 = CullPattern(List=query_types, CullPattern=tmatch_2)
cull_3 = CullPattern(List=query_types, CullPattern=tmatch_3)
list_item = ListItem(List=cull_2, Index=0, Wrap=True)
item = ListItem(List=[cull, cull_3], Index=0, Wrap=True)
list_length = ListLength(List=item)
boolean = Boolean(list_length)
stream_filter = StreamFilter(Gate=boolean, Stream0=list_item, Stream1=item)

# ---- group: Creating new dimension style
duplicate_type = DuplicateType(TypeName="Dimension_RiR", Type=stream_filter, FailureProcessingMode=1, TrackingMode=1)
inspect_element = InspectElement(Element=duplicate_type)
element_parameter = ElementParameter(Element=duplicate_type, Parameter=inspect_element, Value=colour_swatch)  # -> Element, Value

# ----
# Control
# General
# Monitor
# Out
# variable parameters and script execution
# (sliders, boolean togggle, text input,...)
# monitor data and geometry preview (used for panels for example)
# output data to rhino or external platforms
# WIP
# Annotation
# Plugin
# general annotation and notes
# textbased scripting and special plugins
# f.ex: HumanUI, kangaroo,...
# problematic or under repair or construction
# Back-end
dss_annotation_panel_3 = Panel("general development modules")

# ---- group: Level cull
query_categories = QueryCategories(Type=1, Name="Walls", IsSubcategory=False)
inspect_element_2 = InspectElement(Element=active_view)
dss_annotation_panel_4 = Panel(inspect_element_2)
query_graphical_elements = QueryGraphicalElements(View=active_view, Categories=query_categories)
query_levels = QueryLevels(Name=dss_annotation_panel_4, BuildingStory=True)
level_filter = LevelFilter(Levels=query_levels, Inverted=False)
filter_elements = FilterElements(Elements=query_graphical_elements, Filter=level_filter)
cull_pattern = CullPattern(List=query_graphical_elements, CullPattern=filter_elements)

# ---- group: Measure to grids
query_categories_2 = QueryCategories(Type=2, Name="Grids", IsSubcategory=False)
query_graphical_elements_2 = QueryGraphicalElements(View=active_view, Categories=query_categories_2)
curve = Curve(query_graphical_elements_2)

# ---- group: Level cull
wall = Wall(cull_pattern)
curve_2 = Curve(reparameterize(wall))

# ----
category = Category(category_style.Category)
type = Type(element_parameter.Element)

# ---- group: Finds closest grid for each wall
vector = Vector(curve)
vector_2 = Vector(curve_2)
md_slider = MDSlider(SliderMode=0, slider_value=Point(0.5, 0.5, 0.5), x_domain=Domain(0, 1), y_domain=Domain(0, 1), z_domain=Domain(0, 1))
dot_product = DotProduct(VectorA=simplify(graft(vector_2)), VectorB=vector, Unitize=False)  # -> simplify(DotProduct)
surface = Surface(query_graphical_elements_2)
evaluate_surface = EvaluateSurface(Surface=reparameterize(surface), Point=md_slider)  # -> Point, Normal, UDirection, VDirection, Frame
absolute = Absolute(Value=dot_product)
plane_normal = PlaneNormal(Origin=evaluate_surface.Point, ZAxis=evaluate_surface.Normal)
cull_pattern_2 = CullPattern(List=plane_normal, CullPattern=absolute)  # -> simplify(List)

# ----
curve_middle = CurveMiddle(Curve=curve_2)

# ---- group: Finds closest grid for each wall (continued)
plane_closest_point = PlaneClosestPoint(Point=simplify(graft(curve_middle)), Plane=cull_pattern_2)  # -> Point, UVPoint, simplify(Distance)
absolute_2 = Absolute(Value=plane_closest_point.Distance)
sort_list = SortList(Keys=absolute_2, ValuesValuesA=plane_closest_point.Point)  # -> Keys, ValuesValuesA
list_item_2 = ListItem(List=simplify(sort_list.ValuesValuesA), Index=0, Wrap=True)

# ----
line = Line(StartPoint=simplify(graft(curve_middle)), EndPoint=list_item_2)  # -> simplify(graft(Line))

line_2 = Line(flatten(line))

# ---- group: Walls crossed by line
query_view_elements = QueryViewElements(View=active_view, Categories=<geometry referenced from the Revit model>)  # disabled
element_type = ElementType(Element=query_view_elements)  # -> Element, Type; disabled
brec = BoundingRectangle(Geometry=element_type.Element, Plane=PlaneXY(0, 0, 0), Axis=0, Slide=0, Union=False)  # -> Bounding, DimensionX, DimensionY; disabled
ccx = CurveCurve(CurveA=simplify(graft(line_2)), CurveB=simplify(flatten(brec.Bounding)))  # -> Points, ParamsA, ParamsB; disabled

# ---- group: Point exist cull pattern
number_slider = Slider(0, range=0..100)  # disabled
nulls_in_empty = NullsInEmptyBranches(DataWithEmptyBranches=ccx.Points)  # disabled
nullrep = ReplaceNulls(Items=nulls_in_empty, Replacements=number_slider)  # -> Items, Count; disabled
ma = MassAddition(Input=nullrep.Items)  # -> Result, PartialResults; disabled
cluster = Cluster(data=ma.Result)  # disabled
bool = Boolean(cluster)  # disabled

# ---- group: Find referances with normal along line
wall_2 = Wall(wall)
vec = Vector(simplify(graft(line_2)))
element_references = ElementReferences(Element=wall_2)  # -> Element, simplify(Faces), Edges, Lines
cluster_2 = Cluster(data=element_references.Faces)
pln = Plane(cluster_2)
vec_2 = Vector(pln)
tstat = TreeStatistics(Tree=vec_2)  # -> Paths, Length, Count
branch = TreeBranch(Tree=vec, Path=tstat.Paths, MaintainPaths=True)
dprod = DotProduct(VectorA=vec_2, VectorB=branch, Unitize=False)
round = Round(Number=dprod)  # -> Nearest, Floor, Ceiling
smaller = SmallerThan(FirstNumber=round.Nearest, SecondNumber="0")  # -> SmallerThan, OrEqualTo
bool_2 = Boolean(smaller.OrEqualTo)
cull_4 = CullPattern(List=cluster_2, CullPattern=invert(bool_2))
filter = StreamFilter(Gate=toggle, Stream0=cull_4, Stream1=simplify(graft(wall_2)))

# ----
unit_z = UnitZ(Factor=1)
vector_3 = Vector(simplify(graft(line_2)))
cross_product = CrossProduct(VectorA=vector_3, VectorB=unit_z, Unitize=False)  # -> unitize(Vector), Length
multiplication = Multiplication(A=cross_product.Vector, B=Slider(100, range=0..100))
end_points = EndPoints(Curve=simplify(graft(line_2)))  # -> Start, End
negative = Negative(Value=multiplication)
move = Move(Geometry=end_points.End, Motion=negative)  # -> Geometry, Transform
move_2 = Move(Geometry=end_points.End, Motion=multiplication)  # -> Geometry, Transform
line_3 = Line(StartPoint=move_2.Geometry, EndPoint=move.Geometry)
plane = Plane(active_view)
project = Project(Geometry=line_3, Plane=plane)  # -> Geometry, Transform
view = View(active_view)
branch_2 = TreeBranch(Tree=line_3, Path=tstat.Paths, MaintainPaths=True)
add_detail_line = AddDetailLine(View=view, Curve=branch_2)  # -> simplify(DetailLine)

number_slider_2 = Slider(13, range=0..100)
line_4 = Line(line_2)
ext = ExtendCurve(Curve=line_4, Type=0, Start=number_slider_2, End=number_slider_2)

line_5 = Line(simplify(graft(ext)))
curve_line_style = CurveLineStyle(Element=add_detail_line, LineStyle=category)  # -> Element, LineStyle
null = NullItem(Item=line_5)  # -> NullFlags, InvalidFlags, Description
cull_5 = CullPattern(List=line_5, CullPattern=invert(null.NullFlags))
ma_2 = MassAddition(Input=null.NullFlags)  # -> Result, PartialResults

merge = Merge(Data1=filter, Data2=add_detail_line)

clean = CleanTree(RemoveNulls=True, RemoveInvalid=True, RemoveEmpty=True, Tree=cull_5, SynchronousTree1=merge)  # -> Tree, SynchronousTree1

add_aligned_dimension = AddAlignedDimension(View=active_view, References=clean.SynchronousTree1, Line=cull_5, FailureProcessingMode=1)

element_type_2 = ElementType(Element=add_aligned_dimension, Type=type)  # -> Element, Type

# ==== cluster Cluster
data = ClusterInput()

data_2 = Data(data)
tstat = TreeStatistics(Tree=data_2)  # -> Paths, Length, Count
split = TextSplit(Text=tstat.Paths, Separators=";")  # -> simplify(Result)
item = ListItem(List=split, Index="0", Wrap=True)
concat = Concatenate(FragmentA=item, FragmentB="}")
rep = ReplaceText(Text=concat, Find="}}", Replace="}", RecursiveReplace=False)
dup = DuplicateData(Data=rep, Number=simplify(graft(tstat.Length)), Order=True)  # -> flatten(Data)
tree = CreateTree(Data=flatten(data_2), Path=dup)
data_3 = Data(tree)

data_4 = ClusterOutput(data_3)
