# Grasshopper definition 03_Dim_Cat_Center.gh (Grasshopper 1.0.8)
# plug-ins: Pufferfish, Rhino.Inside for Autodesk Revit

doubleclick = BooleanToggle(False)
dss_annotation_panel = Panel("Help on WhiteWork")
# Segment
dss_log_v5_2 = PythonScript(Help=doubleclick)  # inputs Help: Boolean
# ---------- dss_log_v5_2: Python ----------
"""
Set grasshopper template and provide easy acces to Help file in intranet

"""

"""
Credits:
    20211117
    Created by Vladimir Ondejcik
    White arkitekter AB

Based on:
    WOMBAT version <0.0.1>
    Script by <Brian Ringley>
        def libraries() by <Giulio Piacentino> see <http://www.grasshopper3d.com/forum/topics/gh-filename-is-python>
        def writeToFile() by <Data Analytics Society> see <https://www.youtube.com/watch?v=-TF3mXhnCDw>
    Script version <15 September 2015> 
    Copyright <Creative Commons Sharealike>
"""


#add dsearch default path located on cad.local
import sys
new_path = r"\\sesthfs02\DSEARCH\REPOSITORY\Grasshopper\Xtras\DsearchCode"
if new_path not in sys.path: sys.path.append(new_path)

#import dsearch plugin
import dsearch as ds

import os

print sys.path

#reload module (this has use when working on module)
#reload(ds.DS_Log)
#reload(ds.DS_Links)

#setup template
template=ds.DS_Links.Template
ds.DS_Log.DS_Template(template)

#run help from module 
if Help:
    helpLink=ds.DS_Links.HelpLink
    ds.DS_Log.DS_Help(helpLink)

    #turn toggle back to false
    obj=ghenv.Component.Params.Input[0].Sources[0]
    obj.Value=False
    obj.ExpireSolution(True)
# ---------- end dss_log_v5_2 ----------

dss_projectnumber = Panel("0000")
dss_projectname = Panel("name")

# ----
# Organization of Grasshopper scripts at White:
# Script should be created and annotated always with notion that other person will need to use/edit them.
# Build your script in modules and segments, use color coding and annotation according this template.
# This standard should be applied to all scripts, big or small.
# 
# Read  guide on white work:
# "https://work.white.se/grasshopper-developer-guide/"
# For Advanced users:
# For design scripts running more than a month use "dsInitialize" and "dsScriptLog" functions on Dsearch tab to log changes over time.
dss_annotation_panel_2 = Panel("""Tip of a day:
You can change default colour grups by right clicking
Graphical templates are located on "Dsearch" tab""")
# GRAPHIC
# STANDARD
# In
# data and geometry import from rhino or external platforms
image = ImageSampler(dss_annotation_panel_2, Filter="Colour", Interpolate=False, Umax=1, Umin=0, Vmax=1, Vmin=0, Wrap=0)

active_selection = GraphicalElement()

# ---- group: Style of dimension
query_types = QueryTypes(Kind=7)

# ----
type_identity = TypeIdentity(Type=query_types)  # -> Category, FamilyName, Name
panel = Panel("Casework")
position_of_dimension_might_effect_resul = Panel("200")  # "Position of dimension - might effect results"
# group modules into larger coherent parts
element_category = ElementCategory(Element=active_selection)  # -> Element, Category
query_categories = QueryCategories(Type=1, Name="Plumbing Fixtures", IsVisibleUI=True, IsSubcategory=False)
active_view = ActiveView()
tmatch = MatchText(Text=type_identity.FamilyName, RegEx="Linear", Case=True)
lng = ListLength(List=element_category.Category)
cull = CullPattern(List=query_types, CullPattern=tmatch)
# User Interface: I/O
bool = Boolean(lng)
query_categories_2 = QueryCategories(Type=1, Name="Walls", IsVisibleUI=True, IsSubcategory=False)
filter = StreamFilter(Gate=bool, Stream0=query_categories, Stream1=element_category.Category)
list_item = ListItem(List=cull, Index=0, Wrap=True)
query_element_parameters = QueryElementParameters(Element=list_item, ReadOnly=False)
level = Level(active_view)
catfltr = CategoryFilter(Categories=filter, Inverted=False)
levelfltr = LevelFilter(Levels=level, Inverted=False)
levelfltr_2 = LevelFilter(Levels=level, Inverted=False)
query_view_elements = QueryViewElements(View=active_view, Categories=query_categories_2, Filter=levelfltr_2)
andfltr = LogicalAndFilter(FilterA=catfltr, FilterB=levelfltr)
value_picker = ValuePicker(query_element_parameters, SearchPattern="units")

# ---- group: Color of dimensions
colour_swatch = ColourSwatch(SwatchColor=RGB(204, 54, 49))

# ----
query_elements = QueryElements(Filter=andfltr, Limit=500)  # -> Elements, Count
query_parameters = QueryParameters(Type=cull)

# ---- group: Sortering av långsidor Vägg
element_curve = ElementCurve(Element=query_view_elements)  # -> Element, Curve
line = Line(element_curve.Curve)
null = NullItem(Item=line)  # -> NullFlags, InvalidFlags, Description
cull_2 = CullPattern(List=element_curve.Element, CullPattern=invert(null.NullFlags))
cull_3 = CullPattern(List=line, CullPattern=invert(null.NullFlags))
element_references = ElementReferences(Element=cull_2)  # -> simplify(Faces), Edges, Lines
vec = Vector(cull_3)

# ----
tmatch_2 = MatchText(Text=query_types, RegEx="Kontroll", Case=True)
tmatch_3 = MatchText(Text=query_types, RegEx="Längdmåttsättning*", Case=True)
graphical_element = GraphicalElement(query_elements.Elements)
# Some problem with constructiong dimensions
cull_4 = CullPattern(List=cull, CullPattern=tmatch_2)

# ----
# Control
# General
# Monitor
# Out
# variable parameters and script execution
# (sliders, boolean togggle, text input,...)
# monitor data and geometry preview (used for panels for example)
# WIP
# Annotation
# Plugin
# general annotation and notes
# textbased scripting and special plugins
# f.ex: HumanUI, kangaroo,...
dss_annotation_panel_3 = Panel("general development modules")

cull_5 = CullPattern(List=cull, CullPattern=tmatch_3)
item = ListItem(List=cull_4, Index=0, Wrap=True)

# ---- group: Hittar referensplan(finns i nästan alla familjer)
component_reference_plane = ComponentReferencePlane(Component=graphical_element, Name="Center (Left/Right)")

# ---- group: Hittar en centerpunkt att arbeta med
brec = BoundingRectangle(Geometry=simplify(graft(graphical_element)), Plane=PlaneXY(0, 0, 0), Axis=0, Slide=0, Union=True)  # -> Bounding, DimensionX, DimensionY
pcen = PolygonCenter(Polyline=brec.Bounding)  # -> simplify(CenterV), CenterE, CenterA

# ----
lng_2 = ListLength(List=item)
null_2 = NullItem(Item=lng_2)  # -> NullFlags, InvalidFlags, Description
item_2 = ListItem(List=item, Index=0, Wrap=True)
item_3 = ListItem(List=cull_5, Index=Slider(42, range=0..100), Wrap=True)
element_parameter = ElementParameter(Element=cull, Parameter="Units Format")  # -> Element, Value
filter_2 = StreamFilter(Gate=null_2.NullFlags, Stream0=item_2, Stream1=item_3)
null_item = NullItem(Item=filter_2)  # -> NullFlags, InvalidFlags, Description

# ---- group: Flyttar
pln = Plane(component_reference_plane)
# problematic or under repair or construction
pt = Point(pcen.CenterV)
deplane = DeconstructPlane(Plane=pln)  # -> Origin, XAxis, YAxis, ZAxis

# ----
list_item_2 = ListItem(List=cull, Index=0, Wrap=True)
project = Project(Geometry=pt, Plane=simplify(graft(pln)))  # -> simplify(Geometry), Transform
filter_3 = StreamFilter(Gate=null_item.NullFlags, Stream0=filter_2, Stream1=list_item_2)
duplicate_type = DuplicateType(TypeName="Dimension_RiR", Type=filter_3, FailureProcessingMode=1, TrackingMode=2)

# ---- group: Flyttar / Flyttar en punkt för att skapa en vektor
number_slider = Slider(200, range=0..1000)
num = Number(number_slider)
neg = Negative(Value=num)
multiplication = Multiplication(A=deplane.XAxis, B=neg)
num_2 = Number(number_slider)
vec_2 = Vector(multiplication)
neg_2 = Negative(Value=num_2)
move = Move(Geometry=project.Geometry, Motion=simplify(graft(vec_2)))  # -> Geometry, Transform
multiplication_2 = Multiplication(A=deplane.YAxis, B=neg_2)
vec_3 = Vector(multiplication_2)
move_2 = Move(Geometry=move.Geometry, Motion=simplify(graft(vec_3)))  # -> Geometry, Transform

# ----
element_name = ElementName(Element=duplicate_type)  # -> Element, Name

# ---- group: Flyttar / Flyttar en punkt för att flytta dimension bort från objektet
num_3 = Number(position_of_dimension_might_effect_resul)
neg_3 = Negative(Value=num_3)
# output data to rhino or external platforms
multiplication_3 = Multiplication(A=deplane.XAxis, B=neg_3)
vec_4 = Vector(multiplication_3)
num_4 = Number(position_of_dimension_might_effect_resul)
neg_4 = Negative(Value=num_4)
move_3 = Move(Geometry=project.Geometry, Motion=simplify(graft(vec_4)))  # -> Geometry, Transform
multiplication_4 = Multiplication(A=deplane.YAxis, B=neg_4)
vec_5 = Vector(multiplication_4)
move_4 = Move(Geometry=move_3.Geometry, Motion=simplify(graft(vec_5)))  # -> Geometry, Transform

# ---- group: Creating new dimension style
inspect_element = InspectElement(Element=duplicate_type)
element_parameter_2 = ElementParameter(Element=duplicate_type, Parameter=inspect_element, Value=colour_swatch)  # -> Element, Value

# ----
inspect_element_2 = InspectElement(Element=duplicate_type)
element_parameter_3 = ElementParameter(Element=duplicate_type, Parameter=inspect_element_2, Value=Slider(1, range=0..1))  # -> Element, Value

# ---- group: Reducerar antalet väggar till de vinkelräta mot objektets center plan
pt_2 = Point(move_2.Geometry)
pt_3 = Point(project.Geometry)
vec_6 = Vector(unitize(vec))
vec2pt = Vector2Pt(PointA=pt_3, PointB=pt_2, Unitize=False)  # -> unitize(Vector), Length
dprod = DotProduct(VectorA=unitize(vec2pt.Vector), VectorB=unitize(vec_6), Unitize=True)  # -> simplify(DotProduct)
abs = Absolute(Value=dprod)
bool_2 = Boolean(abs)

# ---- group: Hittar den närmaste vägg som elementet är parallelt med
cull_6 = CullPattern(List=flatten(cull_2), CullPattern=bool_2)
# Kanske projektion av linjer ska vara någon annan stans
pt_4 = Point(move_4.Geometry)
line_2 = Line(cull_6)
crv_cp = CurveClosestPoint(Point=pt_4, Curve=reparameterize(line_2))  # -> simplify(Point), simplify(Parameter), simplify(Distance)
bool_3 = Boolean(crv_cp.Parameter)
num_5 = Number(crv_cp.Parameter)
replace = ReplaceMembers(Set=num_5, Find=Slider(1, range=0..1), Replace=Slider(0, range=0..1))
bool_4 = Boolean(replace)
cull_7 = CullPattern(List=crv_cp.Point, CullPattern=bool_4)
cull_8 = CullPattern(List=crv_cp.Distance, CullPattern=bool_4)
cull_9 = CullPattern(List=cull_6, CullPattern=bool_4)
sort = SortList(Keys=cull_8, ValuesA=cull_7)  # -> Keys, simplify(ValuesA)
sort_2 = SortList(Keys=cull_8, ValuesA=cull_9)  # -> Keys, simplify(ValuesA)
pln_2 = Plane(level)
item_4 = ListItem(List=sort.ValuesA, Index=0, Wrap=True)
project_2 = Project(Geometry=pt_4, Plane=pln_2)  # -> Geometry, Transform
project_3 = Project(Geometry=item_4, Plane=pln_2)  # -> Geometry, Transform
ln = Line(StartPoint=project_2.Geometry, EndPoint=project_3.Geometry)
line_3 = Line(ln)

# ---- group: Hittar långsidor på en vägg
item_5 = ListItem(List=sort_2.ValuesA, Index=0, Wrap=True)
md_slider = MDSlider(SliderMode=0, slider_value=Point(0.5, 0.5, 0.5), x_domain=Domain(0, 1), y_domain=Domain(0, 1), z_domain=Domain(0, 1))
line_4 = Line(item_5)
element_references_2 = ElementReferences(Element=item_5)  # -> simplify(Faces), Edges, Lines
Z = UnitZ(Factor=1)
vec_7 = Vector(line_4)
srf = Surface(element_references_2.Faces)
xprod = CrossProduct(VectorA=vec_7, VectorB=Z, Unitize=Toggle(True))  # -> Vector, Length
evalsrf = EvaluateSurface(Surface=srf, Point=md_slider)  # -> Point, Normal, UDirection, VDirection, Frame
dprod_2 = DotProduct(VectorA=simplify(graft(xprod.Vector)), VectorB=evalsrf.Normal, Unitize=False)
abs_2 = Absolute(Value=dprod_2)
cull_10 = CullPattern(List=element_references_2.Faces, CullPattern=abs_2)

# ----
cp = PlaneClosestPoint(Point=move_4.Geometry, Plane=cull_10)  # -> Point, UVPoint, Distance

# ---- group: Hittar långsidor på en vägg (continued)
abs_3 = Absolute(Value=cp.Distance)
sort_3 = SortList(Keys=abs_3, ValuesA=cull_10)  # -> Keys, ValuesA
item_6 = ListItem(List=sort_3.ValuesA, Index=0, Wrap=True)
referenser = Data(item_6)

# ---- group: Collect references and lines and creates dimension
data = Data(item_6)
data_2 = Data(component_reference_plane)
view = View(active_view)
type = Type(element_parameter_2.Element)
line_5 = Line(line_3)

# ---- group: Remove nulls
null_item_2 = NullItem(Item=simplify(graft(data_2)))  # -> NullFlags, InvalidFlags, Description
cull_pattern = CullPattern(List=simplify(graft(data_2)), CullPattern=invert(null_item_2.NullFlags))
clean_tree = CleanTree(
    RemoveNulls=True,
    RemoveInvalid=True,
    RemoveEmpty=True,
    Tree=cull_pattern,
    SynchronousTree1=data,
    SynchronousTree2=line_5)  # -> Tree, SynchronousTree1, SynchronousTree2
null_item_3 = NullItem(Item=simplify(graft(clean_tree.SynchronousTree1)))  # -> NullFlags, InvalidFlags, Description
cull_pattern_2 = CullPattern(List=simplify(graft(clean_tree.SynchronousTree1)), CullPattern=invert(null_item_3.NullFlags))
clean_tree_2 = CleanTree(
    RemoveNulls=True,
    RemoveInvalid=True,
    RemoveEmpty=True,
    Tree=cull_pattern_2,
    SynchronousTree1=clean_tree.Tree,
    SynchronousTree2=clean_tree.SynchronousTree2)  # -> Tree, SynchronousTree1, SynchronousTree2

# ---- group: Collect references and lines and creates dimension (continued)
merge = Merge(Data1=clean_tree_2.SynchronousTree1, Data2=clean_tree_2.Tree)
add_aligned_dimension = AddAlignedDimension(View=simplify(graft(view)), References=merge, Line=clean_tree_2.SynchronousTree2, Type=type)
