# Grasshopper definition 10_Rev_Off Axis_Walls.gh (Grasshopper 1.0.8)
# plug-ins: Pufferfish, Rhino.Inside for Autodesk Revit, Wombat

doubleclick = BooleanToggle(False)
dss_annotation_panel = Panel("Help on WhiteWork")
# Segment
# group modules into larger coherent parts
# User Interface: I/O
dss_log_v5_2 = PythonScript(Help=doubleclick)  # inputs Help: Boolean
# ---------- dss_log_v5_2: Python ----------
"""
Set grasshopper template and provide easy acces to Help file in intranet

"""

"""
Credits:
    20211117
    Created by Vladimir Ondejcik
    White arkitekter AB

Based on:
    WOMBAT version <0.0.1>
    Script by <Brian Ringley>
        def libraries() by <Giulio Piacentino> see <http://www.grasshopper3d.com/forum/topics/gh-filename-is-python>
        def writeToFile() by <Data Analytics Society> see <https://www.youtube.com/watch?v=-TF3mXhnCDw>
    Script version <15 September 2015> 
    Copyright <Creative Commons Sharealike>
"""


#add dsearch default path located on cad.local
import sys
new_path = r"\\sesthfs02\DSEARCH\REPOSITORY\Grasshopper\Xtras\DsearchCode"
if new_path not in sys.path: sys.path.append(new_path)

#import dsearch plugin
import dsearch as ds

import os

print sys.path

#reload module (this has use when working on module)
#reload(ds.DS_Log)
#reload(ds.DS_Links)

#setup template
template=ds.DS_Links.Template
ds.DS_Log.DS_Template(template)

#run help from module 
if Help:
    helpLink=ds.DS_Links.HelpLink
    ds.DS_Log.DS_Help(helpLink)

    #turn toggle back to false
    obj=ghenv.Component.Params.Input[0].Sources[0]
    obj.Value=False
    obj.ExpireSolution(True)
# ---------- end dss_log_v5_2 ----------

dss_projectnumber = Panel("0000")
dss_projectname = Panel("name")

# ----
# Organization of Grasshopper scripts at White:
# Script should be created and annotated always with notion that other person will need to use/edit them.
# Build your script in modules and segments, use color coding and annotation according this template.
# This standard should be applied to all scripts, big or small.
# 
# Read  guide on white work:
# "https://work.white.se/grasshopper-developer-guide/"
# For Advanced users:
# For design scripts running more than a month use "dsInitialize" and "dsScriptLog" functions on Dsearch tab to log changes over time.
dss_annotation_panel_2 = Panel("""Tip of a day:
You can change default colour grups by right clicking
Graphical templates are located on "Dsearch" tab""")
# GRAPHIC
# STANDARD
# In
# data and geometry import from rhino or external platforms
image = ImageSampler(dss_annotation_panel_2, Filter="Colour", Interpolate=False, Umax=1, Umin=0, Vmax=1, Vmin=0, Wrap=0)

query_categories = QueryCategories(Type=1, Name="Walls", IsVisibleUI=True, IsSubcategory=False)
active_view = ActiveView()
visible_in_view_filter = VisibleInViewFilter(View=active_view, Inverted=False)
query_view_elements = QueryViewElements(View=active_view, Categories=query_categories, Filter=visible_in_view_filter)
query_grids = QueryGrids()
active_selection = GraphicalElement(query_view_elements)
vector = Vector(unitize(active_selection))
line = Line(active_selection)
length = Length(Curve=line)

# ----
# Control
# General
# Monitor
# Out
# variable parameters and script execution
# (sliders, boolean togggle, text input,...)
# monitor data and geometry preview (used for panels for example)
# output data to rhino or external platforms
# WIP
# Annotation
# Plugin
# general annotation and notes
# textbased scripting and special plugins
# f.ex: HumanUI, kangaroo,...
# problematic or under repair or construction
dss_annotation_panel_3 = Panel("general development modules")

# ----
# Rotates curve according to closest near pararell gridline - moves hosted elements a little....
midpoint = Midpoint(Curve=line)
line_2 = Line(query_grids)
vector_2 = Vector(line_2)
query_categories_2 = QueryCategories(Type=1, Name="Detail Items", IsVisibleUI=True, IsSubcategory=False)
dot_product = DotProduct(VectorA=unitize(simplify(graft(vector))), VectorB=unitize(vector_2), Unitize=False)  # -> simplify(DotProduct)
query_types = QueryTypes(Kind=3, Category=query_categories_2)
absolute = Absolute(Value=dot_product)
radians = Radians(Degrees=Slider(1, range=0..10))
round_to_decimal_place = RoundToDecimalPlace(NumberX=absolute, DecimalPlace="5", RoundType=0)  # -> Rounded, Difference
cosine = Cosine(Value=radians)
match_text = MatchText(Text=query_types, RegEx="Solid", Case=True)
round_to_decimal_place_2 = RoundToDecimalPlace(NumberX=cosine, DecimalPlace="5", RoundType=0)  # -> Rounded, Difference
# Back-end
smaller_than = SmallerThan(FirstNumber=round_to_decimal_place.Rounded, SecondNumber=round_to_decimal_place_2.Rounded)  # -> SmallerThan, OrEqualTo
cull_pattern = CullPattern(List=query_types, CullPattern=match_text)
cull_pattern_2 = CullPattern(List=line_2, CullPattern=invert(smaller_than.SmallerThan))
list_length = ListLength(List=cull_pattern)
list_item = ListItem(List=query_types, Index=Slider(2, range=0..10), Wrap=True)
list_item_2 = ListItem(List=cull_pattern, Index=0, Wrap=True)
null_item = NullItem(Item=simplify(cull_pattern_2))  # -> NullFlags, InvalidFlags, Description
boolean = Boolean(list_length)
stream_gate = StreamGate(Gate=0)  # -> Target0, Target1
stream_filter = StreamFilter(Gate=boolean, Stream0=list_item, Stream1=list_item_2)
cull_pattern_3 = CullPattern(List=simplify(cull_pattern_2), CullPattern=invert(null_item.NullFlags))
duplicate_type = DuplicateType(TypeName="Filled Region_RiR", Type=stream_filter, FailureProcessingMode=1, TrackingMode=2)
query_element_parameters = QueryElementParameters(Element=duplicate_type, Name="Foreground Pattern Color")
duplicate_type_2 = DuplicateType(TypeName="Filled Region_RiR_2", Type=stream_filter, FailureProcessingMode=1, TrackingMode=2)
query_element_parameters_2 = QueryElementParameters(Element=duplicate_type_2, Name="Foreground Pattern Color")
colour = Colour(ColourSwatch(SwatchColor=RGB(255, 0, 0)))
colour_2 = Colour(ColourSwatch(SwatchColor=RGB(255, 196, 0)))
curve_closest_point = CurveClosestPoint(Point=simplify(graft(midpoint)), Curve=cull_pattern_3)  # -> Point, Parameter, simplify(Distance)
sort_list = SortList(Keys=curve_closest_point.Distance, ValuesValuesA=simplify(cull_pattern_3))  # -> Keys, ValuesValuesA
list_item_3 = ListItem(List=sort_list.ValuesValuesA, Index=0, Wrap=True)  # -> simplify(Item)
element_parameter = ElementParameter(Element=duplicate_type, Parameter=query_element_parameters, Value=colour)  # -> Element, Value
element_parameter_2 = ElementParameter(Element=duplicate_type_2, Parameter=query_element_parameters_2, Value=colour_2)  # -> Element, Value
vector_3 = Vector(list_item_3)
vector_4 = Vector(unitize(vector_3))
query_fill_patterns = QueryFillPatterns(Type=0)
vector_5 = Vector()
dot_product_2 = DotProduct(VectorA=simplify(graft(vector)), VectorB=vector_4, Unitize=False)
absolute_2 = Absolute(Value=dot_product_2)
match_text_2 = MatchText(Text=query_fill_patterns, RegEx="Solid", Case=True)
data = Data()
cull_pattern_4 = CullPattern(List=query_fill_patterns, CullPattern=match_text_2)
list_length_2 = ListLength(List=data)
stream_filter_2 = StreamFilter(Gate=list_length_2, Stream0=cull_pattern_4, Stream1=data)
query_element_parameters_3 = QueryElementParameters(Element=duplicate_type, Name="Foreground Fill Pattern")
query_element_parameters_4 = QueryElementParameters(Element=duplicate_type, Name="Foreground Fill Pattern")
unit_z = UnitZ(Factor=1)
unit_z_2 = UnitZ(Factor=1)
list_item_4 = ListItem(List=cull_pattern_4, Index=0, Wrap=True)
subtraction = Subtraction(A=absolute_2, B="1")
similarity = Similarity(FirstNumber=subtraction, SecondNumber="0", Threshold="1")  # -> Similarity, AbsoluteDifference
cull_pattern_5 = CullPattern(List=list_item_3, CullPattern=invert(similarity.Similarity))
smaller_than_2 = SmallerThan(FirstNumber=similarity.AbsoluteDifference, SecondNumber="0.000001")  # -> SmallerThan, OrEqualTo
cull_pattern_6 = CullPattern(List=cull_pattern_5, CullPattern=invert(smaller_than_2.SmallerThan))
cull_pattern_7 = CullPattern(List=cull_pattern_5, CullPattern=smaller_than_2.SmallerThan)
clean_tree = CleanTree(RemoveNulls=True, RemoveInvalid=True, RemoveEmpty=True, Tree=cull_pattern_7)
clean_tree_2 = CleanTree(RemoveNulls=True, RemoveInvalid=True, RemoveEmpty=True, Tree=cull_pattern_6)
tree_statistics = TreeStatistics(Tree=clean_tree)  # -> Paths, Length, Count
tree_statistics_2 = TreeStatistics(Tree=clean_tree_2)  # -> Paths, Length, Count
equality = Equality(FirstNumber=subtraction, SecondNumber="0")  # -> Equality, Inequality
tree_branch = TreeBranch(Tree=simplify(graft(active_selection)), Path=tree_statistics.Paths, MaintainPaths=True)
tree_branch_2 = TreeBranch(Tree=simplify(graft(active_selection)), Path=tree_statistics_2.Paths, MaintainPaths=True)
line_3 = Line(tree_branch)
vector_6 = Vector(line_3)
cross_product = CrossProduct(VectorA=vector_6, VectorB=unit_z, Unitize=False)  # -> Vector, Length
line_4 = Line(tree_branch_2)
vector_7 = Vector(line_4)
cross_product_2 = CrossProduct(VectorA=vector_7, VectorB=unit_z_2, Unitize=False)  # -> Vector, Length
select_element = SelectElement(Element=flatten(tree_branch), Selected=Toggle(True))  # -> Element, Selected; disabled
curve_middle = CurveMiddle(Curve=line_3)
panel = Panel(similarity.Similarity)
select_element_2 = SelectElement(Element=flatten(tree_branch_2), Selected=Toggle(True))  # -> Element, Selected; disabled
construct_plane = ConstructPlane(Origin=curve_middle, XAxis=unitize(line_3), YAxis=unitize(cross_product.Vector))
curve_middle_2 = CurveMiddle(Curve=line_4)
construct_plane_2 = ConstructPlane(Origin=curve_middle_2, XAxis=unitize(line_4), YAxis=unitize(cross_product_2.Vector))
bounding_rectangle = BoundingRectangle(Geometry=tree_branch, Plane=construct_plane, Axis=0, Slide=0, Union=True)  # -> Bounding, DimensionX, DimensionY
panel_2 = Panel(similarity.AbsoluteDifference)
bounding_rectangle_2 = BoundingRectangle(Geometry=tree_branch_2, Plane=construct_plane_2, Axis=0, Slide=0, Union=True)  # -> Bounding, DimensionX, DimensionY
element_parameter_3 = ElementParameter(Element=duplicate_type, Parameter=query_element_parameters_3, Value=list_item_4)  # -> Element, Value
add_region = AddRegion(View=active_view, Boundary=simplify(bounding_rectangle.Bounding), Type=element_parameter_2.Element, TrackingMode=1)  # -> flatten(Region)
add_region_2 = AddRegion(View=active_view, Boundary=simplify(bounding_rectangle_2.Bounding), Type=duplicate_type, TrackingMode=1)
