# Grasshopper definition 11_Ro_Wall_Off Axis.gh (Grasshopper 1.0.8)
# plug-ins: Pufferfish, Rhino.Inside for Autodesk Revit, Wombat

doubleclick = BooleanToggle(False)
dss_annotation_panel = Panel("Help on WhiteWork")
# Segment
# group modules into larger coherent parts
# User Interface: I/O
dss_log_v5_2 = PythonScript(Help=doubleclick)  # inputs Help: Boolean
# ---------- dss_log_v5_2: Python ----------
"""
Set grasshopper template and provide easy acces to Help file in intranet

"""

"""
Credits:
    20211117
    Created by Vladimir Ondejcik
    White arkitekter AB

Based on:
    WOMBAT version <0.0.1>
    Script by <Brian Ringley>
        def libraries() by <Giulio Piacentino> see <http://www.grasshopper3d.com/forum/topics/gh-filename-is-python>
        def writeToFile() by <Data Analytics Society> see <https://www.youtube.com/watch?v=-TF3mXhnCDw>
    Script version <15 September 2015> 
    Copyright <Creative Commons Sharealike>
"""


#add dsearch default path located on cad.local
import sys
new_path = r"\\sesthfs02\DSEARCH\REPOSITORY\Grasshopper\Xtras\DsearchCode"
if new_path not in sys.path: sys.path.append(new_path)

#import dsearch plugin
import dsearch as ds

import os

print sys.path

#reload module (this has use when working on module)
#reload(ds.DS_Log)
#reload(ds.DS_Links)

#setup template
template=ds.DS_Links.Template
ds.DS_Log.DS_Template(template)

#run help from module 
if Help:
    helpLink=ds.DS_Links.HelpLink
    ds.DS_Log.DS_Help(helpLink)

    #turn toggle back to false
    obj=ghenv.Component.Params.Input[0].Sources[0]
    obj.Value=False
    obj.ExpireSolution(True)
# ---------- end dss_log_v5_2 ----------

dss_projectnumber = Panel("0000")
dss_projectname = Panel("name")

# ----
# Organization of Grasshopper scripts at White:
# Script should be created and annotated always with notion that other person will need to use/edit them.
# Build your script in modules and segments, use color coding and annotation according this template.
# This standard should be applied to all scripts, big or small.
# 
# Read  guide on white work:
# "https://work.white.se/grasshopper-developer-guide/"
# For Advanced users:
# For design scripts running more than a month use "dsInitialize" and "dsScriptLog" functions on Dsearch tab to log changes over time.
dss_annotation_panel_2 = Panel("""Tip of a day:
You can change default colour grups by right clicking
Graphical templates are located on "Dsearch" tab""")
# GRAPHIC
# STANDARD
# In
# data and geometry import from rhino or external platforms
image = ImageSampler(dss_annotation_panel_2, Filter="Colour", Interpolate=False, Umax=1, Umin=0, Vmax=1, Vmin=0, Wrap=0)

query_categories = QueryCategories(Type=1, Name="Walls", IsVisibleUI=True, IsSubcategory=False)
active_selection = GraphicalElement()
query_grids = QueryGrids()
category_filter = CategoryFilter(Categories=query_categories, Inverted=False)
filter_elements = FilterElements(Elements=active_selection, Filter=category_filter)
cull_pattern = CullPattern(List=active_selection, CullPattern=filter_elements)
active_selection_2 = GraphicalElement(cull_pattern)
line = Line(active_selection_2)
null_item = NullItem(Item=line)  # -> NullFlags, InvalidFlags, Description
cull_pattern_2 = CullPattern(List=line, CullPattern=invert(null_item.NullFlags))
cull_pattern_3 = CullPattern(List=active_selection_2, CullPattern=invert(null_item.NullFlags))
line_2 = Line(cull_pattern)
graphical_element = GraphicalElement(simplify(graft(cull_pattern_3)))

# ----
# Control
# General
# Monitor
# Out
# variable parameters and script execution
# (sliders, boolean togggle, text input,...)
# monitor data and geometry preview (used for panels for example)
# output data to rhino or external platforms
# WIP
# Annotation
# Plugin
# general annotation and notes
# textbased scripting and special plugins
# f.ex: HumanUI, kangaroo,...
# problematic or under repair or construction
dss_annotation_panel_3 = Panel("general development modules")

vector = Vector(unitize(cull_pattern))
line_3 = Line(query_grids)
graphical_element_2 = GraphicalElement(simplify(graft(graphical_element)))
line_4 = Line(line_3)
vector_2 = Vector(line_3)

vector_3 = Vector(unitize(line_4))
vector_4 = Vector(vector_3)
vector_5 = Vector(unitize(vector_4))
negative = Negative(Value=vector_5)
line_5 = Line(graphical_element_2)
vector_6 = Vector(unitize(line_5))
create_set = CreateSet(List=flatten([negative, vector_5]))  # -> Set, Map
set_difference = SetDifference(SetA=graft(vector_6), SetB=create_set.Set)  # -> simplify(Union)
list_length = ListLength(List=set_difference)
boolean = Boolean(list_length)
cull_pattern_4 = CullPattern(List=graphical_element_2, CullPattern=boolean)

# ----
# Rotates curve according to closest near pararell gridline
dot_product = DotProduct(VectorA=unitize(simplify(graft(vector))), VectorB=unitize(vector_2), Unitize=False)
# Back-end
absolute = Absolute(Value=dot_product)
radians = Radians(Degrees=Slider(1, range=0..10))
round_to_decimal_place = RoundToDecimalPlace(NumberX=absolute, DecimalPlace="10", RoundType=0)  # -> Rounded, Difference
cosine = Cosine(Value=radians)
round_to_decimal_place_2 = RoundToDecimalPlace(NumberX=cosine, DecimalPlace="10", RoundType=0)  # -> Rounded, Difference
line_6 = Line(cull_pattern_4)
smaller_than = SmallerThan(FirstNumber=round_to_decimal_place.Rounded, SecondNumber=round_to_decimal_place_2.Rounded)  # -> SmallerThan, OrEqualTo
vector_7 = Vector(line_6)
midpoint = Midpoint(Curve=line_2)
dot_product_2 = DotProduct(VectorA=unitize(vector_7), VectorB=unitize(flatten(vector_3)), Unitize=False)
absolute_2 = Absolute(Value=dot_product_2)
cull_pattern_5 = CullPattern(List=line_3, CullPattern=invert(smaller_than.SmallerThan))
subtraction = Subtraction(A=absolute_2, B="1")
curve_closest_point = CurveClosestPoint(Point=simplify(graft(midpoint)), Curve=cull_pattern_5)  # -> Point, Parameter, Distance
absolute_3 = Absolute(Value=subtraction)
length = Length(Curve=line_6)
curve_middle = CurveMiddle(Curve=line_6)
panel = Panel(subtraction)
sort_list = SortList(Keys=absolute_3, ValuesValuesA=vector_4)  # -> Keys, ValuesValuesA
sort_list_2 = SortList(Keys=curve_closest_point.Distance, ValuesValuesA=cull_pattern_5)  # -> Keys, simplify(ValuesValuesA)
list_item = ListItem(List=sort_list.ValuesValuesA, Index=0, Wrap=True)  # -> simplify(Item)
list_item_2 = ListItem(List=sort_list_2.ValuesValuesA, Index=0, Wrap=True)  # -> simplify(Item)
vector_8 = Vector(list_item_2)
vector_9 = Vector(list_item)
negative_2 = Negative(Value=vector_9)
line_7 = Line(cull_pattern_4)
vector_10 = Vector(line_7)
angle = Angle(VectorA=vector_10, VectorB=negative_2)  # -> Angle, Reflex
angle_2 = Angle(VectorA=vector_10, VectorB=vector_9)  # -> Angle, Reflex
graphical_element_3 = GraphicalElement(cull_pattern_4)
degrees = Degrees(Radians=[angle_2.Angle, angle.Angle, angle_2.Reflex, angle.Reflex])
sort_list_3 = SortList(Keys=degrees)  # -> Keys, ValuesValuesA
line_8 = Line(graphical_element_3)
list_item_3 = ListItem(List=sort_list_3.Keys, Index=0, Wrap=True)
larger_than = LargerThan(FirstNumber=list_item_3, SecondNumber="1")  # -> LargerThan, OrEqualTo
cull_pattern_6 = CullPattern(List=graphical_element_3, CullPattern=invert(larger_than.LargerThan))
element_passport = ElementPassport(Element=cull_pattern_6)  # -> DocumentGUID, Document, UniqueID, Id
query_element = QueryElement(Id=element_passport.Id)
line_9 = Line(line_2)

number_slider = Slider(1, range=0..1)
deconstruct = Deconstruct(Point=curve_middle)  # -> XComponent, YComponent, ZComponent
vector_11 = Vector(unitize(list_item))
round_to_decimal_place_3 = RoundToDecimalPlace(NumberX=deconstruct.YComponent, DecimalPlace=number_slider, RoundType=0)  # -> Rounded, Difference
round_to_decimal_place_4 = RoundToDecimalPlace(NumberX=deconstruct.XComponent, DecimalPlace=number_slider, RoundType=0)  # -> Rounded, Difference
division = Division(A=length, B=Slider(2, range=0..10))
construct_point = ConstructPoint(
    XCoordinate=round_to_decimal_place_4.Rounded,
    YCoordinate=round_to_decimal_place_3.Rounded,
    ZCoordinate=deconstruct.ZComponent)

cull_pattern_7 = CullPattern(List=vector_11, CullPattern=invert(larger_than.LargerThan))

line_sdl = LineSDL(Start=simplify(graft(construct_point)), Direction=cull_pattern_7, Length=simplify(graft(length)))
multiplication = Multiplication(A=cull_pattern_7, B=simplify(graft(division)))
negative_3 = Negative(Value=multiplication)
move = Move(Geometry=line_sdl, Motion=negative_3)  # -> Geometry, Transform
flip_curve = FlipCurve(Curve=move.Geometry, Guide=simplify(graft(line_8)))  # -> reparameterize(Curve), Flag
list_length_2 = ListLength(List=flatten(flip_curve.Curve))
boolean_2 = Boolean(list_length_2)
stream_filter = StreamFilter(Gate=boolean_2, Stream1=flip_curve.Curve)

active_view = ActiveView()
curve_middle_2 = CurveMiddle(Curve=stream_filter)
plane = Plane(active_view)
radians_2 = Radians(Degrees="0.1")
host_inserts = HostInserts(Host=query_element)  # -> Inserts, Shared, Shadows, Openings, Walls
element_location = ElementLocation(Element=simplify(host_inserts.Inserts))  # -> Element, Location
element_curve = ElementCurve(Element=cull_pattern_6, Curve=stream_filter, FailureProcessingMode=1)  # -> Element, Curve
point = Point(element_location.Location)
line_10 = Line(element_curve.Element)
curve_closest_point_2 = CurveClosestPoint(Point=point, Curve=reparameterize(simplify(graft(line_10))))  # -> simplify(Point), Parameter, Distance
list_length_3 = ListLength(List=flatten(element_curve.Element))
boolean_3 = Boolean(list_length_3)
project = Project(Geometry=curve_closest_point_2.Point, Plane=element_location.Location)  # -> Geometry, Transform

deconstruct_plane = DeconstructPlane(Plane=plane)  # -> Origin, XAxis, YAxis, ZAxis
construct_plane = ConstructPlane(Origin=curve_middle_2, XAxis=deconstruct_plane.XAxis, YAxis=deconstruct_plane.YAxis)
list_length_4 = ListLength(List=element_location.Location)
boolean_4 = Boolean(list_length_4)
panel_2 = Panel(element_location.Location)
addition = Addition(A=boolean_3, B="0")

rotate = Rotate(Geometry=stream_filter, Angle=radians_2, Plane=construct_plane)  # -> Geometry, Transform
stream_filter_2 = StreamFilter(Gate=addition, Stream1=project.Geometry)
element_location_2 = ElementLocation(Element=simplify(graft(host_inserts.Inserts)), Location=simplify(graft(stream_filter_2)), FailureProcessingMode=2)  # -> Element, Location, Hand, Facing, WorkPlane

flip_curve_2 = FlipCurve(Curve=rotate.Geometry, Guide=simplify(graft(line_2)))  # -> reparameterize(Curve), Flag
line_11 = Line(flip_curve_2.Curve)

element_curve_2 = ElementCurve(Curve=flip_curve_2.Curve, FailureProcessingMode=2)  # -> Element, Curve; disabled
