# Grasshopper definition 21_LFilter.gh (Grasshopper 1.0.8)
# plug-ins: Rhino.Inside for Autodesk Revit, eleFront

doubleclick = BooleanToggle(False)
dss_annotation_panel = Panel("Help on WhiteWork")
# Segment
# group modules into larger coherent parts
dss_log_v5_2 = PythonScript(Help=doubleclick)  # inputs Help: Boolean
# ---------- dss_log_v5_2: Python ----------
"""
Set grasshopper template and provide easy acces to Help file in intranet

"""

"""
Credits:
    20211117
    Created by Vladimir Ondejcik
    White arkitekter AB

Based on:
    WOMBAT version <0.0.1>
    Script by <Brian Ringley>
        def libraries() by <Giulio Piacentino> see <http://www.grasshopper3d.com/forum/topics/gh-filename-is-python>
        def writeToFile() by <Data Analytics Society> see <https://www.youtube.com/watch?v=-TF3mXhnCDw>
    Script version <15 September 2015> 
    Copyright <Creative Commons Sharealike>
"""


#add dsearch default path located on cad.local
import sys
new_path = r"\\sesthfs02\DSEARCH\REPOSITORY\Grasshopper\Xtras\DsearchCode"
if new_path not in sys.path: sys.path.append(new_path)

#import dsearch plugin
import dsearch as ds

import os

print sys.path

#reload module (this has use when working on module)
#reload(ds.DS_Log)
#reload(ds.DS_Links)

#setup template
template=ds.DS_Links.Template
ds.DS_Log.DS_Template(template)

#run help from module 
if Help:
    helpLink=ds.DS_Links.HelpLink
    ds.DS_Log.DS_Help(helpLink)

    #turn toggle back to false
    obj=ghenv.Component.Params.Input[0].Sources[0]
    obj.Value=False
    obj.ExpireSolution(True)
# ---------- end dss_log_v5_2 ----------

dss_projectnumber = Panel("0000")
# DSS_Author: Staffan Linné
# Staffan.Linne@white.se
# Annotation
# Name of script
# QFilter
# 
# Latest update
# 
# Intent:
# To create a filter based on the Category, Type (Type Name), Family and Type Mark of an model object.
# 
# Prerequisites:
# Rhino
# Revit
# Rhino Inside Revit
# 
# Instructions:
# The script is best runned from the Revit Toolbar - see White Works link..
# 
# 1. Select an object (or several) in the Revit viewport
# 2. Run script
# 3. The script will create a filter and apply a random colour to the filter
# 4. If you like to keep the filter, change the name, otherwise it will be updated next time you use Qfilter
# 
# Limitations:
# Has not been tested for linked models
# Does not work for certain object categories, for example views (section, elevations etc.) and annotation objects,
# 
# Contact:
# Staffan Linné
# Staffan.linne@white.se
dss_projectname = Panel("name")

# ----
# Organization of Grasshopper scripts at White:
# Script should be created and annotated always with notion that other person will need to use/edit them.
# Build your script in modules and segments, use color coding and annotation according this template.
# This standard should be applied to all scripts, big or small.
# 
# Read  guide on white work:
# "https://work.white.se/grasshopper-developer-guide/"
# For Advanced users:
# For design scripts running more than a month use "dsInitialize" and "dsScriptLog" functions on Dsearch tab to log changes over time.
dss_annotation_panel_2 = Panel("""Tip of a day:
You can change default colour grups by right clicking
Graphical templates are located on "Dsearch" tab""")
# GRAPHIC
# STANDARD
# In
# data and geometry import from rhino or external platforms
image_sampler = ImageSampler(dss_annotation_panel_2, Filter="Colour", Interpolate=False, Umax=1, Umin=0, Vmax=1, Vmin=0, Wrap=0)

active_selection = GraphicalElement()

# ----
# Control
# General
# Monitor
# Out
# variable parameters and script execution
# (sliders, boolean togggle, text input,...)
# monitor data and geometry preview (used for panels for example)
# output data to rhino or external platforms
# WIP
# Annotation
# Plugin
# general annotation and notes
# textbased scripting and special plugins
# f.ex: HumanUI, kangaroo,...
# problematic or under repair or construction
dss_annotation_panel_3 = Panel("general development modules")

text = Text(active_selection)
text_split = TextSplit(Text=text, Separators=":")
list_item = ListItem(List=text_split, Index="1", Wrap=True)
text_trim = TextTrim(Text=list_item, Start=True, End=True)
query_revit_links = QueryRevitLinks()  # -> Links, Documents
text_2 = Text(query_revit_links.Documents)

replace_nulls = ReplaceNulls(Items=text_trim, Replacements="kdfjfkf")  # -> Items, Count

match_text = MatchText(Text=text_2, RegEx=replace_nulls.Items, Case=True)
cull_pattern = CullPattern(List=query_revit_links.Documents, CullPattern=match_text)

query_categories = QueryCategories(Document=cull_pattern, Type=1, IsVisibleUI=True, IsSubcategory=False)
category_filter = CategoryFilter(Categories=simplify(graft(query_categories)), Inverted=False)
query_elements = QueryElements(Document=cull_pattern, Filter=category_filter)  # -> simplify(Elements), Count
clean_tree = CleanTree(RemoveNulls=True, RemoveInvalid=True, RemoveEmpty=True, Tree=query_elements.Elements)
document_identity = DocumentIdentity(Document=cull_pattern)  # -> Document, DocumentID, ModelPath, Name, Title, IsFamily, UnitSystem
active_selection_2 = GraphicalElement(flatten(clean_tree))
null_item = NullItem(Item=active_selection_2)  # -> NullFlags, InvalidFlags, Description
cull_pattern_2 = CullPattern(List=active_selection_2, CullPattern=invert(null_item.NullFlags))
text_3 = Text(document_identity.Name)
element_type = ElementType(Element=cull_pattern_2)  # -> Element, Type
create_set = CreateSet(List=element_type.Type)  # -> Set, Map
create_tree = CreateTree(Data=cull_pattern_2, Path=create_set.Map)
list_item_2 = ListItem(List=create_tree, Index=0, Wrap=True)

# ---- group: Selected graphical element in Revit viewport
active_selection_3 = GraphicalElement(flatten(list_item_2))

# ---- group: Time Stamp
python = PythonScript(x=Button())  # -> out, Y, M, D, h, m, s
# ---------- python: Python ----------
import datetime
now = datetime.datetime.now()
Y = now.year
M = now.month
D = now.day
h = now.hour
m = now.minute
s = now.second
# ---------- end python ----------
len = TextLength(Text=python.M)
smaller = SmallerThan(FirstNumber=len, SecondNumber="2")  # -> SmallerThan, OrEqualTo
concat = Concatenate(FragmentA="0", FragmentB=python.M)
filter = StreamFilter(Gate=len, Stream0=python.M, Stream1=concat)
expression = Expression(Y=python.Y, M=filter, D=python.D, Expression="Format(\"{0}-{1}-{2}\", Y, M, D)")
panel = Panel(expression)
suffix = Panel("_Change Name!")
concat_2 = Concatenate(FragmentB=text_3, FragmentA=panel, JoinSeparator="_")

# ----
element_type_2 = ElementType(Element=active_selection_3)  # -> Element, Type
type_identity = TypeIdentity(Type=element_type_2.Type)  # -> Category, FamilyName, Name

# ---- group: Colours
white_färger_bakgrund = Panel("""249, 164, 216
133, 216, 200
216, 121, 135
175, 168, 157
99, 208, 90
255, 199, 44
185, 158, 178
0, 125, 153
149, 88, 100
105, 124, 125
89, 119, 101
246, 80, 88""")
colour = Colour(white_färger_bakgrund)
item = ListItem(List=colour, Index=python.s, Wrap=True)

# ---- group: Filter graphics override
col = Colour(item)
query_fill_patterns = QueryFillPatterns(Name="?Solid", Type=0)
item_2 = ListItem(List=query_fill_patterns, Index=0, Wrap=True)
graphic_overrides = GraphicOverrides(
    ColorProjectionLines=col,
    ForegroundPatternSurfacePatterns=item_2,
    ForegroundColorSurfacePatterns=col,
    ForegroundVisibleCutPatterns=Toggle(True),
    ForegroundPatternCutPatterns=item_2,
    ForegroundColorCutPatterns=col)

# ---- group: Category
element_category = ElementCategory(Element=active_selection_3)  # -> Element, Category
category_identity = CategoryIdentity(Category=type_identity.Category)  # -> Discipline, Type, Name, IsVisibleUI, IsSubcategory

# ----
query_categories_2 = QueryCategories(Type=category_identity.Type, Name=category_identity.Name, IsVisibleUI=True, IsSubcategory=False)  # -> flatten(Categories)

# ---- group: Category (continued)
cset = CreateSet(List=query_categories_2)  # -> Set, Map

# ---- group: Family OR-Filter
element_type_3 = ElementType(Element=active_selection_3)  # -> Element, Type
typident = TypeIdentity(Type=element_type_3.Type)  # -> Category, FamilyName, Name

# ---- group: Type Name OR-Filter
element_parameter = ElementParameter(Element=element_type_3.Type, Parameter="Type Name")  # -> Element, Parameter, Value
cset_2 = CreateSet(List=element_parameter.Value)  # -> Set, Map
item_3 = ListItem(List=element_parameter.Parameter, Index=0, Wrap=True)
equals = EqualsRule(Parameter=item_3, Value=cset_2.Set)  # -> graft(Rule)
parafltr = ParameterFilter(Rules=equals, Inverted=False)  # -> flatten(Filter)
union = UnionFilter(Filters=parafltr)

# ---- group: Type Mark OR-Filter
element_parameter_2 = ElementParameter(Element=element_type_3.Type, Parameter="Type Mark")  # -> Element, Parameter, Value
cset_3 = CreateSet(List=element_parameter_2.Value)  # -> Set, Map
item_4 = ListItem(List=element_parameter_2.Parameter, Index=0, Wrap=True)
equals_2 = EqualsRule(Parameter=item_4, Value=cset_3.Set)  # -> graft(Rule)
parafltr_2 = ParameterFilter(Rules=equals_2, Inverted=False)  # -> flatten(Filter)
union_2 = UnionFilter(Filters=parafltr_2)

# ----
create_set_2 = CreateSet(List=typident.FamilyName)  # -> Set, Map

# ---- group: Family OR-Filter (continued)
famfltr = FamilyFilter(FamilyName=create_set_2.Set, Inverted=False)
union_3 = UnionFilter(Filters=famfltr)

# ----
null_item_2 = NullItem(Item=element_parameter_2.Value)  # -> NullFlags, InvalidFlags, Description
list_length = ListLength(List=cset_3.Set)
mass_addition = MassAddition(Input=null_item_2.NullFlags)  # -> Result, PartialResults
boolean = Boolean(invert(mass_addition.Result))

# ---- group: AND-Filter
andfltr = LogicalAndFilter(FilterA=union_3, FilterB=union, FilterC=union_2)

# ----
boolean_2 = Boolean(mass_addition.Result)
andfltr_2 = LogicalAndFilter(FilterA=union_3, FilterB=union)
stream_filter = StreamFilter(Gate=boolean_2, Stream0=list_length, Stream1=boolean)
stream_filter_2 = StreamFilter(Gate=stream_filter, Stream0=andfltr_2, Stream1=andfltr)

add_rule_based_filter = AddRuleBasedFilter(Name=concat_2, Categories=cset.Set, Filter=stream_filter_2, FailureProcessingMode=1)
active_view = ActiveView()

# ---- group: Cheking if view has view template or not
inspect = InspectElement(Element=active_view)

# ----
view = View(inspect)

# ---- group: Cheking if view has view template or not (continued)
view_identity = ViewIdentity(View=view)  # -> Discipline, ViewFamily, ViewName, IsDependent, ViewDependency, IsTemplate, ViewTemplate, IsAssembly, AssociatedAssembly, IsPrintable
bool = Boolean(view_identity.IsTemplate)
null = NullItem(Item=bool)  # -> NullFlags, InvalidFlags, Description
bool_2 = Boolean(invert(null.NullFlags))
filter_2 = StreamFilter(Gate=bool_2, Stream0=active_view, Stream1=inspect)

# ---- group: Adding filter to filter list
view_filters = ViewFilters(View=filter_2)  # -> View, Filters

# ----
merge = Merge(Data1=view_filters.Filters, Data2=add_rule_based_filter)  # -> flatten(Result)

view_filters_2 = ViewFilters(View=filter_2, Filters=merge, FailureProcessingMode=1)  # -> View, Filters
filter_graphic_overrides = FilterGraphicOverrides(View=view_filters_2.View, Filter=add_rule_based_filter, Overrides=graphic_overrides)  # -> View, Filter, Hidden, Overrides
