# Grasshopper definition 22_Filled Reg_Ele.gh (Grasshopper 1.0.8)
# plug-ins: Pufferfish, Rhino.Inside for Autodesk Revit

doubleclick = BooleanToggle(False)
dss_annotation_panel = Panel("Help on WhiteWork")
# Segment
# group modules into larger coherent parts
# User Interface: I/O
dss_log_v5_2 = PythonScript(Help=doubleclick)  # inputs Help: Boolean
# ---------- dss_log_v5_2: Python ----------
"""
Set grasshopper template and provide easy acces to Help file in intranet

"""

"""
Credits:
    20211117
    Created by Vladimir Ondejcik
    White arkitekter AB

Based on:
    WOMBAT version <0.0.1>
    Script by <Brian Ringley>
        def libraries() by <Giulio Piacentino> see <http://www.grasshopper3d.com/forum/topics/gh-filename-is-python>
        def writeToFile() by <Data Analytics Society> see <https://www.youtube.com/watch?v=-TF3mXhnCDw>
    Script version <15 September 2015> 
    Copyright <Creative Commons Sharealike>
"""


#add dsearch default path located on cad.local
import sys
new_path = r"\\sesthfs02\DSEARCH\REPOSITORY\Grasshopper\Xtras\DsearchCode"
if new_path not in sys.path: sys.path.append(new_path)

#import dsearch plugin
import dsearch as ds

import os

print sys.path

#reload module (this has use when working on module)
#reload(ds.DS_Log)
#reload(ds.DS_Links)

#setup template
template=ds.DS_Links.Template
ds.DS_Log.DS_Template(template)

#run help from module 
if Help:
    helpLink=ds.DS_Links.HelpLink
    ds.DS_Log.DS_Help(helpLink)

    #turn toggle back to false
    obj=ghenv.Component.Params.Input[0].Sources[0]
    obj.Value=False
    obj.ExpireSolution(True)
# ---------- end dss_log_v5_2 ----------

dss_projectnumber = Panel("0000")
dss_projectname = Panel("name")

# ----
# Organization of Grasshopper scripts at White:
# Script should be created and annotated always with notion that other person will need to use/edit them.
# Build your script in modules and segments, use color coding and annotation according this template.
# This standard should be applied to all scripts, big or small.
# 
# Read  guide on white work:
# "https://work.white.se/grasshopper-developer-guide/"
# For Advanced users:
# For design scripts running more than a month use "dsInitialize" and "dsScriptLog" functions on Dsearch tab to log changes over time.
dss_annotation_panel_2 = Panel("""Tip of a day:
You can change default colour grups by right clicking
Graphical templates are located on "Dsearch" tab""")
# GRAPHIC
# STANDARD
# In
# data and geometry import from rhino or external platforms
image = ImageSampler(dss_annotation_panel_2, Filter="Colour", Interpolate=False, Umax=1, Umin=0, Vmax=1, Vmin=0, Wrap=0)

active_selection = GraphicalElement()

# ---- group: Background pattern
colour = Colour(ColourSwatch(SwatchColor=RGB(179, 179, 179)))

# ----
active_view = ActiveView()
view = View(active_view)
element_view_geometry = ElementViewGeometry(Elements=active_selection, View=active_view)  # -> simplify(Geometry)
plane = Plane(view)

# ----
# Control
# General
# Monitor
# Out
# variable parameters and script execution
# (sliders, boolean togggle, text input,...)
# monitor data and geometry preview (used for panels for example)
# output data to rhino or external platforms
# WIP
# Annotation
# Plugin
# problematic or under repair or construction
# general annotation and notes
# textbased scripting and special plugins
# f.ex: HumanUI, kangaroo,...
dss_annotation_panel_3 = Panel("general development modules")

element_location = ElementLocation(Element=simplify(graft(active_selection)))  # -> Element, Location, Hand, Facing, WorkPlane
deconstruct_brep = DeconstructBrep(Brep=element_view_geometry)  # -> Faces, Edges, Vertices
project = Project(Geometry=deconstruct_brep.Edges, Plane=plane)  # -> Geometry, Transform
query_categories = QueryCategories(Type=1, Name="Detail Items", IsVisibleUI=True, IsSubcategory=False)
bounding_rectangle = BoundingRectangle(Geometry=element_location.Element, Plane=element_location.Location, Axis=0, Slide=0, Union=True)  # -> Bounding, DimensionX, DimensionY
null_item = NullItem(Item=project.Geometry)  # -> NullFlags, InvalidFlags, Description
query_types = QueryTypes(Kind=3, Category=query_categories)
# Back-end
# Fungerar med element med bra geometri  - Annars får man gå på tyngre metod från script för rumskompletteringar
cull_pattern = CullPattern(List=project.Geometry, CullPattern=invert(null_item.InvalidFlags))  # -> simplify(List)
join_curves = JoinCurves(Curves=cull_pattern, Preserve=False)  # -> simplify(Curves)
curve = Curve(element_view_geometry)
match_text = MatchText(Text=query_types, RegEx="Solid", Case=True)
region_union = RegionUnion(Curves=join_curves, Plane=plane)  # -> simplify(Result)
join_curves_2 = JoinCurves(Curves=curve, Preserve=False)
view_2 = View(active_view)
type = Type(SelectedBuiltInCategory="autodesk.revit.category.family:detailComponents")
cull_pattern_2 = CullPattern(List=query_types, CullPattern=match_text)
curve_2 = Curve(flatten([region_union, join_curves_2]))
list_length = ListLength(List=cull_pattern_2)
list_item = ListItem(List=query_types, Index=Slider(2, range=0..10), Wrap=True)
region_union_2 = RegionUnion(Curves=curve_2, Plane=plane)
list_length_2 = ListLength(List=region_union_2)
list_item_2 = ListItem(List=cull_pattern_2, Index=0, Wrap=True)
boolean = Boolean(list_length)
stream_gate = StreamGate(Gate=0)  # -> Target0, Target1
boolean_2 = Boolean(list_length_2)
stream_filter = StreamFilter(Gate=boolean_2, Stream0=bounding_rectangle.Bounding, Stream1=region_union_2)
stream_filter_2 = StreamFilter(Gate=boolean, Stream0=list_item, Stream1=list_item_2)
duplicate_type = DuplicateType(TypeName="Filled Region_RiR_Temp", Type=stream_filter_2, FailureProcessingMode=1, TrackingMode=2)
add_region = AddRegion(View=view_2, Boundary=simplify(graft(stream_filter)), Type=duplicate_type)
pin_element = PinElement(Element=add_region, Pinned=Toggle(False))  # -> Element, Pinned
panel = Panel("45")

colour_2 = Colour(ColourSwatch(SwatchColor=RGB(44, 42, 42)))

# ---- group: Fill Pattern Graphics
query_element_parameters = QueryElementParameters(Element=duplicate_type, Name="Background Fill Pattern")
query_element_parameters_2 = QueryElementParameters(Element=duplicate_type, Name="Foreground Fill Pattern")
query_fill_patterns = QueryFillPatterns(Type=0)
match_text_2 = MatchText(Text=query_fill_patterns, RegEx="Solid", Case=True)
query_element_parameters_3 = QueryElementParameters(Element=duplicate_type, Name="Foreground Pattern Color")
query_element_parameters_4 = QueryElementParameters(Element=duplicate_type, Name="Background Pattern Color")
cull_pattern_3 = CullPattern(List=query_fill_patterns, CullPattern=match_text_2)
colour_3 = Colour(colour)
colour_4 = Colour(colour_2)
element_parameter = ElementParameter(Element=duplicate_type, Parameter=query_element_parameters_4, Value=colour_3)  # -> Element, Value
element_parameter_2 = ElementParameter(Element=duplicate_type, Parameter=query_element_parameters_3, Value=colour_4)  # -> Element, Value

# ---- group: Background pattern
data = Data(query_fill_patterns)
value_picker = ValuePicker(data)

# ----
data_2 = Data(query_fill_patterns)
value_picker_2 = ValuePicker(data_2, SearchPattern="Foreground pattern")

data_3 = Data(value_picker)
match_text_3 = MatchText(Text=query_fill_patterns, RegEx="45", Case=True)
data_4 = Data(value_picker_2)
cull_pattern_4 = CullPattern(List=query_fill_patterns, CullPattern=match_text_3)

# ---- group: Fill Pattern Graphics (continued)
list_length_3 = ListLength(List=data_3)
stream_filter_3 = StreamFilter(Gate=list_length_3, Stream0=cull_pattern_3, Stream1=data_3)
element_parameter_3 = ElementParameter(Element=duplicate_type, Parameter=query_element_parameters, Value=stream_filter_3)  # -> Element, Value

# ----
list_length_4 = ListLength(List=data_4)
stream_filter_4 = StreamFilter(Gate=list_length_4, Stream0=cull_pattern_4, Stream1=data_4)
list_item_3 = ListItem(List=stream_filter_4, Index=0, Wrap=True)
element_parameter_4 = ElementParameter(Element=duplicate_type, Parameter=query_element_parameters_2, Value=list_item_3)  # -> Element, Value
