# Grasshopper definition 22_Iso_Sel_Cat.gh (Grasshopper 1.0.8)
# plug-ins: Rhino.Inside for Autodesk Revit

doubleclick = BooleanToggle(False)
dss_annotation_panel = Panel("Help on WhiteWork")
# Segment
# User Interface: I/O
dss_log_v5_2 = PythonScript(Help=doubleclick)  # inputs Help: Boolean
# ---------- dss_log_v5_2: Python ----------
"""
Set grasshopper template and provide easy acces to Help file in intranet

"""

"""
Credits:
    20211117
    Created by Vladimir Ondejcik
    White arkitekter AB

Based on:
    WOMBAT version <0.0.1>
    Script by <Brian Ringley>
        def libraries() by <Giulio Piacentino> see <http://www.grasshopper3d.com/forum/topics/gh-filename-is-python>
        def writeToFile() by <Data Analytics Society> see <https://www.youtube.com/watch?v=-TF3mXhnCDw>
    Script version <15 September 2015> 
    Copyright <Creative Commons Sharealike>
"""


#add dsearch default path located on cad.local
import sys
new_path = r"\\sesthfs02\DSEARCH\REPOSITORY\Grasshopper\Xtras\DsearchCode"
if new_path not in sys.path: sys.path.append(new_path)

#import dsearch plugin
import dsearch as ds

import os

print sys.path

#reload module (this has use when working on module)
#reload(ds.DS_Log)
#reload(ds.DS_Links)

#setup template
template=ds.DS_Links.Template
ds.DS_Log.DS_Template(template)

#run help from module 
if Help:
    helpLink=ds.DS_Links.HelpLink
    ds.DS_Log.DS_Help(helpLink)

    #turn toggle back to false
    obj=ghenv.Component.Params.Input[0].Sources[0]
    obj.Value=False
    obj.ExpireSolution(True)
# ---------- end dss_log_v5_2 ----------

dss_projectnumber = Panel("0000")
dss_projectname = Panel("name")

# ----
# Organization of Grasshopper scripts at White:
# Script should be created and annotated always with notion that other person will need to use/edit them.
# Build your script in modules and segments, use color coding and annotation according this template.
# This standard should be applied to all scripts, big or small.
# 
# Read  guide on white work:
# "https://work.white.se/grasshopper-developer-guide/"
# For Advanced users:
# For design scripts running more than a month use "dsInitialize" and "dsScriptLog" functions on Dsearch tab to log changes over time.
dss_annotation_panel_2 = Panel("""Tip of a day:
You can change default colour grups by right clicking
Graphical templates are located on "Dsearch" tab""")
# GRAPHIC
# STANDARD
# In
# data and geometry import from rhino or external platforms
image = ImageSampler(dss_annotation_panel_2, Filter="Colour", Interpolate=False, Umax=1, Umin=0, Vmax=1, Vmin=0, Wrap=0)

parameter_name = Panel("View Name")

# ---- group: Categories visible in view
# group modules into larger coherent parts
active_view = ActiveView()
visfltr = VisibleInViewFilter(View=active_view, Inverted=False)
# general annotation and notes
query_view_elements = QueryViewElements(View=active_view, Filter=visfltr)
element_category = ElementCategory(Element=query_view_elements)  # -> Element, Category
cset = CreateSet(List=element_category.Category)  # -> Set, Map

# ---- group: If there is selection -run code
active_selection = GraphicalElement()
inspect = InspectElement(Element=active_view)
element_category_2 = ElementCategory(Element=active_selection)  # -> Element, Category
lng = ListLength(List=active_selection)
cset_2 = CreateSet(List=element_category_2.Category)  # -> Set, Map
bool = Boolean(lng)
filter = StreamFilter(Gate=bool, Stream1=inspect)

# ---- group: Checks if temporary viewport exists...
view = View(inspect)
txt = Text(parameter_name)
suffix_temporary_view_template = Panel("_RiR")
element_parameter = ElementParameter(Element=view, Parameter=txt)  # -> Element, Value
txt_2 = Text(suffix_temporary_view_template)
replace_text = ReplaceText(Text=element_parameter.Value, Find=suffix_temporary_view_template, RecursiveReplace=False)
concat = Concatenate(FragmentA=element_parameter.Value, FragmentB=txt_2)
query_views = QueryViews(ViewName=concat, IsDependent=False, IsTemplate=True)
query_views_2 = QueryViews(ViewName=replace_text, IsDependent=False, IsTemplate=True)
lng_2 = ListLength()

# ----
# Control
# General
# Monitor
# Out
# variable parameters and script execution
# (sliders, boolean togggle, text input,...)
# monitor data and geometry preview (used for panels for example)
# WIP
# Annotation
# Plugin
# textbased scripting and special plugins
# f.ex: HumanUI, kangaroo,...
# problematic or under repair or construction
dss_annotation_panel_3 = Panel("general development modules")

# ---- group: Creates new temp tempate if temp template does not exist / View template
view_2 = View(query_views_2)

# ----
addition = Addition(A=lng_2, B="0")

# ---- group: Creates new temp tempate if temp template does not exist / Naming
txt_3 = Text(parameter_name)
element_parameter_2 = ElementParameter(Element=view_2, Parameter=txt_3)  # -> Element, Value
txt_4 = Text(suffix_temporary_view_template)
concat_2 = Concatenate(FragmentA=element_parameter_2.Value, FragmentB=txt_4)

# ---- group: Creates new temp tempate if temp template does not exist
filter_2 = StreamFilter(Gate=addition, Stream0=view_2)
filter_3 = StreamFilter(Gate=bool, Stream1=filter_2)
duplicate_element = DuplicateElement(Elements=filter_3)  # -> Elements, Duplicates
txt_5 = Text(parameter_name)
element_parameter_3 = ElementParameter(Element=duplicate_element.Duplicates, Parameter=txt_5, Value=concat_2)  # -> Element, Value

# ----
query_views_3 = QueryViews(IsDependent=False, IsTemplate=True)
value_picker = ValuePicker(query_views_3, SearchPattern="_RiR")

# ---- group: Checks that temp view template been created
# Verkar inte klara av att gömma views... kan behövas någon typ av extra funktion för det...
lng_3 = ListLength(List=element_parameter_3.Element)
bool_2 = Boolean(lng_3)
filter_4 = StreamFilter(Gate=bool_2, Stream1=inspect)

# ----
# output data to rhino or external platforms
difference = SetDifference(SetA=cset.Set, SetB=cset_2.Set)
delete_element = DeleteElement(Elements=value_picker)  # disabled

# ---- group: Check if template have RiR suffix, if it is so -delete it
match_text = MatchText(Text=inspect, RegEx=suffix_temporary_view_template, Case=True)
filter_5 = StreamFilter(Gate=match_text, Stream0=element_parameter_3.Element, Stream1=query_views_2)

# ----
category_graphic_overrides = CategoryGraphicOverrides(View=element_parameter_3.Element, Category=difference, Hidden=Toggle(True))  # -> View, Category, Hidden, Overrides
element_parameter_4 = ElementParameter(Element=active_view, Parameter="View Template", Value=filter_5)  # -> Element, Value
txt_6 = Text(parameter_name)
element_parameter_5 = ElementParameter(Element=element_parameter_4.Value, Parameter=txt_6)  # -> Element, Value
txt_7 = Text(suffix_temporary_view_template)
concat_3 = Concatenate(FragmentA=element_parameter_5.Value, FragmentB=txt_7)
query_views_4 = QueryViews(ViewName=concat_3, IsDependent=False, IsTemplate=True)
delete_element_2 = DeleteElement(Elements=query_views_4)
