# Grasshopper definition 31_Show_Red.gh (Grasshopper 1.0.8)
# plug-ins: Rhino.Inside for Autodesk Revit

doubleclick = BooleanToggle(False)
dss_annotation_panel = Panel("Help on WhiteWork")
# Segment
# group modules into larger coherent parts
# User Interface: I/O
dss_log_v5_2 = PythonScript(Help=doubleclick)  # inputs Help: Boolean
# ---------- dss_log_v5_2: Python ----------
"""
Set grasshopper template and provide easy acces to Help file in intranet

"""

"""
Credits:
    20211117
    Created by Vladimir Ondejcik
    White arkitekter AB

Based on:
    WOMBAT version <0.0.1>
    Script by <Brian Ringley>
        def libraries() by <Giulio Piacentino> see <http://www.grasshopper3d.com/forum/topics/gh-filename-is-python>
        def writeToFile() by <Data Analytics Society> see <https://www.youtube.com/watch?v=-TF3mXhnCDw>
    Script version <15 September 2015> 
    Copyright <Creative Commons Sharealike>
"""


#add dsearch default path located on cad.local
import sys
new_path = r"\\sesthfs02\DSEARCH\REPOSITORY\Grasshopper\Xtras\DsearchCode"
if new_path not in sys.path: sys.path.append(new_path)

#import dsearch plugin
import dsearch as ds

import os

print sys.path

#reload module (this has use when working on module)
#reload(ds.DS_Log)
#reload(ds.DS_Links)

#setup template
template=ds.DS_Links.Template
ds.DS_Log.DS_Template(template)

#run help from module 
if Help:
    helpLink=ds.DS_Links.HelpLink
    ds.DS_Log.DS_Help(helpLink)

    #turn toggle back to false
    obj=ghenv.Component.Params.Input[0].Sources[0]
    obj.Value=False
    obj.ExpireSolution(True)
# ---------- end dss_log_v5_2 ----------

dss_tags = Panel("tags, tags")
dss_description = Panel("description")

# ----
# PROJECT INFO
dss_projectnumber = Panel("0000")
dss_projectname = Panel("name")

# ----
# Organization of Grasshopper scripts at White:
# Script should be created and annotated always with notion that other person will need to use/edit them.
# Build your script in modules and segments, use color coding and annotation according this template.
# This standard should be applied to all scripts, big or small.
# 
# Read  guide on white work:
# "https://work.white.se/grasshopper-developer-guide/"
# READ ME
# For Advanced users:
# For design scripts running more than a month use "dsInitialize" and "dsScriptLog" functions on Dsearch tab to log changes over time.
dss_annotation_panel_2 = Panel("""Tip of a day:
You can change default colour grups by right clicking
Graphical templates are located on "Dsearch" tab""")
# GRAPHIC
# STANDARD
# In
# data and geometry import from rhino or external platforms
image = ImageSampler(dss_annotation_panel_2, Filter="Colour", Interpolate=False, Umax=1, Umin=0, Vmax=1, Vmin=0, Wrap=0)

# ---- group: Colour (Red)
text = Text("255,0,0")
panel = Panel(text)

# ----
boolean_toggle = BooleanToggle(False)
active_view = ActiveView()

match_text = MatchText(Text=active_view, RegEx="Sheet", Case=True)
cull_pattern = CullPattern(List=active_view, CullPattern=match_text)
sheet = Sheet(cull_pattern)
query_viewports = QueryViewports(Sheet=sheet)

panel_2 = Panel("""Schedule
Elevation
Legend
3D View
Section
Floor Plan
Section
Area Plan
Area Plan
Ceiling Plan
Section
Detail View
Drafting View""")
query_types = QueryTypes(Kind=3, FamilyName=panel_2)  # -> flatten(Types)
cset = CreateSet(List=query_types)  # -> Set, Map
typefltr = TypeFilter(Types=cset.Set, Inverted=False)
filtelem = FilterElements(Elements=query_viewports, Filter=typefltr)
cull = CullPattern(List=query_viewports, CullPattern=invert(filtelem))

# ----
# Control
# General
# Monitor
# Out
# variable parameters and script execution
# (sliders, boolean togggle, text input,...)
# monitor data and geometry preview (used for panels for example)
# output data to rhino or external platforms
# WIP
# Annotation
# Plugin
# general annotation and notes
# textbased scripting and special plugins
# f.ex: HumanUI, kangaroo,...
# problematic or under repair or construction
# Back-end
dss_annotation_panel_3 = Panel("general development modules")

view = View(cull)

# ---- group: Views på sheets / Workset hack for views
element_workset = ElementWorkset(Element=view)  # -> Element, Workset, Status
workset_identity = WorksetIdentity(Workset=element_workset.Workset)  # -> Kind, Name, Owner, Open, Editable, Visible
query_worksets = QueryWorksets(Kind=2)
workset_identity_2 = WorksetIdentity(Workset=query_worksets)  # -> Kind, Name, Owner, Open, Editable, Visible
match_text_2 = MatchText(Text=workset_identity_2.Name, Pattern=simplify(graft(workset_identity.Name)), Case=True)
cull_pattern_2 = CullPattern(List=query_worksets, CullPattern=match_text_2)  # -> simplify(List)
list_item = ListItem(List=cull_pattern_2, Index=Slider(1, range=0..1), Wrap=True)

# ---- group: I view / Workset hack for views
element_workset_2 = ElementWorkset(Element=active_view)  # -> Element, Workset, Status
workset_identity_3 = WorksetIdentity(Workset=element_workset_2.Workset)  # -> Kind, Name, Owner, Open, Editable, Visible
query_worksets_2 = QueryWorksets(Kind=2)
workset_identity_4 = WorksetIdentity(Workset=query_worksets_2)  # -> Kind, Name, Owner, Open, Editable, Visible
match_text_3 = MatchText(Text=workset_identity_4.Name, Pattern=workset_identity_3.Name, Case=False)
cull_pattern_3 = CullPattern(List=query_worksets_2, CullPattern=match_text_3)
list_item_2 = ListItem(List=cull_pattern_3, Index=Slider(1, range=0..1), Wrap=True)

# ----
value_picker = ValuePicker(workset_identity_4.Name, SearchPattern="A-40-P")
panel_3 = Panel(workset_identity_3.Name)

# ---- group: I view
workset = Workset(list_item_2)
workset_filter = WorksetFilter(Workset=workset, Inverted=False)
workset_2 = Workset(list_item_2)
workset_filter_2 = WorksetFilter(Workset=workset_2, Inverted=False)

# ---- group: I view / Lines
query_categories = QueryCategories(Type=1, Name="Lines", IsSubcategory=False)
category_filter = CategoryFilter(Categories=query_categories, Inverted=False)
logical_and_filter = LogicalAndFilter(FilterA=category_filter, FilterB=workset_filter)

# ----
visfltr = VisibleInViewFilter(View=active_view, Inverted=False)
text_2 = Text(panel)
text_3 = Text(panel)
text_4 = Text(panel)

# ---- group: I view / Texts
text_5 = Text("autodesk.revit.category.local:textNotes")
panel_4 = Panel(text_5)
category_filter_2 = CategoryFilter(Categories=panel_4, Inverted=False)
logical_and_filter_2 = LogicalAndFilter(FilterA=category_filter_2, FilterB=workset_filter_2)

# ---- group: I view / Lines
query_categories_2 = QueryCategories(Type=2, Name="Dimensions", IsSubcategory=False)

workset_3 = Workset(list_item_2)
workset_filter_3 = WorksetFilter(Workset=workset_3, Inverted=False)
category_filter_3 = CategoryFilter(Categories=query_categories_2, Inverted=False)
logical_and_filter_3 = LogicalAndFilter(FilterA=category_filter_3, FilterB=workset_filter_3)

# ---- group: Views på sheets / Lines
query_categories_3 = QueryCategories(Type=2, Name="Dimensions", IsSubcategory=False)

workset_4 = Workset(list_item)
workset_filter_4 = WorksetFilter(Workset=workset_4, Inverted=False)
category_filter_4 = CategoryFilter(Categories=query_categories_3, Inverted=False)
logical_and_filter_4 = LogicalAndFilter(FilterA=category_filter_4, FilterB=workset_filter_4)  # -> simplify(Filter)

# ---- group: Views på sheets / Texts
query_categories_4 = QueryCategories(Type=2, Name="Text Notes", IsSubcategory=False)
category_filter_5 = CategoryFilter(Categories=query_categories_4, Inverted=False)

# ---- group: Views på sheets / Lines
query_categories_5 = QueryCategories(Type=1, Name="Lines", IsSubcategory=False)
category_filter_6 = CategoryFilter(Categories=query_categories_5, Inverted=False)

# ---- group: Views på sheets
workset_5 = Workset(list_item)
workset_filter_5 = WorksetFilter(Workset=workset_5, Inverted=False)
workset_6 = Workset(list_item)
workset_filter_6 = WorksetFilter(Workset=workset_6, Inverted=False)
relay = Relay()

# ---- group: Views på sheets / Lines (continued)
logical_and_filter_5 = LogicalAndFilter(FilterA=category_filter_6, FilterB=workset_filter_5)

# ---- group: I view / Lines
query_elements = QueryElements(Filter=logical_and_filter_3, Limit=120000)  # -> Elements, Count

element_type = ElementType(Element=query_elements.Elements)  # -> Element, Type
inspect_element = InspectElement(Element=element_type.Type)
text_6 = Text(panel)

# ----
text_7 = Text(inspect_element)
match_text_4 = MatchText(Text=text_7, RegEx=text_6, Case=True)

# ---- group: I view / Lines (continued)
cull_pattern_4 = CullPattern(List=query_elements.Elements, CullPattern=match_text_4)
graphical_element = GraphicalElement(cull_pattern_4)

element_graphic_overrides = ElementGraphicOverrides(View=active_view, Element=graphical_element, Hidden=boolean_toggle, FailureProcessingMode=1)  # -> View, Element, Hidden, Overrides

query_elements_2 = QueryElements(Filter=logical_and_filter, Limit=120000)  # -> Elements, Count
inspect_element_2 = InspectElement(Element=query_elements_2.Elements)

category_style = CategoryStyle(Category=inspect_element_2)  # -> Category, LineWeight_projection, LineWeight_cut, LineColor, LinePattern_projection, Material
text_8 = Text(panel)

# ----
text_9 = Text(category_style.LineColor)
match_text_5 = MatchText(Text=text_9, RegEx=text_8, Case=True)

# ---- group: I view / Lines (continued)
cull_pattern_5 = CullPattern(List=query_elements_2.Elements, CullPattern=match_text_5)
graphical_element_2 = GraphicalElement(cull_pattern_5)

curve_element = CurveElement(graphical_element_2)
element_graphic_overrides_2 = ElementGraphicOverrides(View=active_view, Element=curve_element, Hidden=boolean_toggle, FailureProcessingMode=1)  # -> View, Element, Hidden, Overrides

# ---- group: I view / Texts
query_elements_3 = QueryElements(Filter=logical_and_filter_2, Limit=120000)  # -> Elements, Count

element_type_2 = ElementType(Element=query_elements_3.Elements)  # -> Element, Type
inspect_element_3 = InspectElement(Element=element_type_2.Type)
text_10 = Text(panel)

# ---- group: Views på sheets / Texts (continued)
logical_and_filter_6 = LogicalAndFilter(FilterA=category_filter_5, FilterB=workset_filter_6)

# ---- group: Views på sheets / Lines
query_elements_4 = QueryElements(Filter=logical_and_filter_4, Limit=120000)  # -> Elements, Count

# ---- group: Views på sheets (continued)
element_type_3 = ElementType(Element=query_elements_4.Elements)  # -> Element, Type
inspect_element_4 = InspectElement(Element=element_type_3.Type)
text_11 = Text(inspect_element_4)
match_text_6 = MatchText(Text=text_11, RegEx=text_2, Case=True)

# ---- group: Views på sheets / Lines (continued)
cull_pattern_6 = CullPattern(List=query_elements_4.Elements, CullPattern=match_text_6)  # -> simplify(List)
graphical_element_3 = GraphicalElement(cull_pattern_6)

element_graphic_overrides_3 = ElementGraphicOverrides(View=simplify(graft(view)), Element=graphical_element_3, Hidden=boolean_toggle, FailureProcessingMode=1)  # -> View, Element, Hidden, Overrides

query_elements_5 = QueryElements(Filter=logical_and_filter_5, Limit=120000)  # -> Elements, Count
inspect_element_5 = InspectElement(Element=query_elements_5.Elements)

# ---- group: Views på sheets / Texts
query_elements_6 = QueryElements(Filter=logical_and_filter_6, Limit=120000)  # -> Elements, Count

# ---- group: Views på sheets / Lines
category_style_2 = CategoryStyle(Category=inspect_element_5)  # -> Category, LineWeight_projection, LineWeight_cut, LineColor, LinePattern_projection, Material

# ----
text_12 = Text(category_style_2.LineColor)
match_text_7 = MatchText(Text=text_12, RegEx=text_3, Case=True)

# ---- group: Views på sheets / Lines (continued)
cull_pattern_7 = CullPattern(List=query_elements_5.Elements, CullPattern=match_text_7)  # -> simplify(List)
graphical_element_4 = GraphicalElement(cull_pattern_7)

curve_element_2 = CurveElement(graphical_element_4)
element_graphic_overrides_4 = ElementGraphicOverrides(View=simplify(graft(view)), Element=curve_element_2, Hidden=boolean_toggle, FailureProcessingMode=1)  # -> View, Element, Hidden, Overrides

# ---- group: Views på sheets / Texts (continued)
element_type_4 = ElementType(Element=query_elements_6.Elements)  # -> Element, Type
inspect_element_6 = InspectElement(Element=element_type_4.Type)  # -> simplify(GraphicsColor)

# ----
text_13 = Text(inspect_element_6)
match_text_8 = MatchText(Text=text_13, RegEx=text_4, Case=True)

# ---- group: Views på sheets / Texts (continued)
cull_pattern_8 = CullPattern(List=query_elements_6.Elements, CullPattern=match_text_8)
graphical_element_5 = GraphicalElement(simplify(cull_pattern_8))

element_graphic_overrides_5 = ElementGraphicOverrides(View=simplify(graft(view)), Element=graphical_element_5, Hidden=boolean_toggle, FailureProcessingMode=1)  # -> View, Element, Hidden, Overrides

# ---- group: I view / Texts (continued)
text_14 = Text(inspect_element_3)
match_text_9 = MatchText(Text=text_14, RegEx=text_10, Case=True)

cull_pattern_9 = CullPattern(List=query_elements_3.Elements, CullPattern=match_text_9)
graphical_element_6 = GraphicalElement(cull_pattern_9)

element_graphic_overrides_6 = ElementGraphicOverrides(View=active_view, Element=graphical_element_6, Hidden=boolean_toggle, FailureProcessingMode=1)  # -> View, Element, Hidden, Overrides
